# Grasshopper definition 160330_UDP_test.gh (Grasshopper 0.9.76)
# plug-ins: gHowl, HDTReference

panel = Panel("192.168.0.11")

# ---- group: \n
panel_2 = Panel("")

# ---- group: \t
panel_3 = Panel("\t")

# ----
netsource = NetworkSource()  # -> NetworkAdapterIsUp, AdapterProperties, LocalIpAddress; disabled
txt = Text("192.168.126.1")
udp = UDPReceiver(Address="127.0.0.1", Port="7001", Pattern=0)  # -> Info, Data
txt_2 = Text(udp.Data)
split = TextSplit(Text=txt_2, Separators=panel_2)
split_2 = TextSplit(Text=split, Separators=",")
udp_2 = UDPSender(Address=txt, Port=6001, Pattern=0)  # disabled
srf4pt = _4PointSurface(CornerA="-2,-1,0", CornerB="2,-1,0", CornerC="2,1,0", CornerD="-2,1,0")
panel_4 = Panel(txt)
panel_5 = Panel(split_2)
panel_6 = Panel(split)
panel_7 = Panel("C:\Users\RYAN\Documents\GitHub\CityScope_PEV_Sim\Map\PEV_PSG AND PKG_300DPI.png")
srf = Surface(srf4pt)
panel_8 = Panel(udp.Info)
panel_9 = Panel(udp.Data)
item = ListItem(List=panel_5, Index=0, Wrap=True)
pshift = ShiftPaths(Data=item, Offset=-1)
item_2 = ListItem(List=pshift, Index=0, Wrap=True)

# ---- group: PEV center pt
pt = Point(panel_6)

# ----
vec2pt = Vector2Pt(PointA=Point(0, 0, 0), PointB=pt, Unitize=False)  # -> Vector, Length
move = Move(Geometry=srf, Motion=vec2pt.Vector)  # -> Geometry, Transform
previewmat = CustomPreviewMaterials(
    Geometry=move.Geometry,
    DiffuseColor=ColourSwatch(SwatchColor=RGB(255, 255, 255)),
    Transparency="0.01",
    DiffuseBitmap=panel_7)
division = Division(A=item_2, B=3)
pt_2 = ConstructPoint(XCoordinate=division, YCoordinate=division, ZCoordinate=0)
