# Grasshopper definition 160406_CityMatrix.gh (Grasshopper 0.9.76)
# plug-ins: Python Interpreter, HDTReference

# ---- group: module meshes lego ref
mesh = Mesh([<mesh referenced from the Rhino model> x9])  # disabled

# ---- group: colortizer orgin
# CityMatrix
# 
# by Yan "Ryan" Zhang <ryanz@mit.edu>
# for MIT Media Lab, Changing Place Group, CityScope Project
# March.17th.2016
# Grid System (CityMatrix 16x16)
pt = Point(<point referenced from the Rhino model>)

# ---- group: table size ref pt
pt_2 = Point(<point referenced from the Rhino model>)

# ---- group: mesh coloring
swatch = ColourSwatch(SwatchColor=RGB(251, 255, 122))  # disabled
mesh_2 = Mesh(<mesh referenced from the Rhino model>)  # disabled
swatch_2 = ColourSwatch(SwatchColor=RGB(255, 122, 122))  # disabled
swatch_3 = ColourSwatch(SwatchColor=RGB(255, 255, 255))  # disabled
swatch_4 = ColourSwatch(SwatchColor=RGB(120, 120, 120))  # disabled
swatch_5 = ColourSwatch(SwatchColor=RGB(0, 0, 0))  # disabled
mcol = MeshColours(Mesh=mesh_2, Colours=swatch_5)  # disabled
mesh_3 = Mesh(mcol)  # disabled

swatch_6 = ColourSwatch(SwatchColor=RGB(0, 0, 0))  # disabled
swatch_7 = ColourSwatch(SwatchColor=RGB(255, 255, 255))  # disabled
swatch_8 = ColourSwatch(SwatchColor=RGB(251, 255, 122))  # disabled
swatch_9 = ColourSwatch(SwatchColor=RGB(120, 120, 120))  # disabled
brep = Brep(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)  # disabled
swatch_10 = ColourSwatch(SwatchColor=RGB(255, 122, 122))  # disabled
brep_2 = Brep([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])  # disabled
brep_3 = Brep([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])  # disabled
brep_4 = Brep(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)  # disabled
brep_5 = Brep([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])  # disabled
jagged = SettingsSpeed()  # disabled
jagged_2 = SettingsSpeed()  # disabled
jagged_3 = SettingsSpeed()  # disabled
jagged_4 = SettingsSpeed()  # disabled
jagged_5 = SettingsSpeed()  # disabled
mesh_4 = MeshBrep(Brep=brep, Settings=jagged)  # disabled
mesh_5 = MeshBrep(Brep=brep_2, Settings=jagged_2)  # disabled
mesh_6 = MeshBrep(Brep=brep_3, Settings=jagged_3)  # disabled
mesh_7 = MeshBrep(Brep=brep_4, Settings=jagged_4)  # disabled
mesh_8 = MeshBrep(Brep=brep_5, Settings=jagged_5)  # disabled
mjoin = MeshJoin(Meshes=mesh_4)  # disabled
mjoin_2 = MeshJoin(Meshes=mesh_5)  # disabled
mjoin_3 = MeshJoin(Meshes=mesh_6)  # disabled
mjoin_4 = MeshJoin(Meshes=mesh_7)  # disabled
mjoin_5 = MeshJoin(Meshes=mesh_8)  # disabled
mcol_2 = MeshColours(Mesh=mjoin_3, Colours=swatch_7)  # disabled
mcol_3 = MeshColours(Mesh=mjoin, Colours=swatch_8)  # disabled
mcol_4 = MeshColours(Mesh=mjoin_2, Colours=swatch_6)  # disabled
mcol_5 = MeshColours(Mesh=mjoin_4, Colours=swatch_10)  # disabled
mcol_6 = MeshColours(Mesh=mjoin_5, Colours=swatch_9)  # disabled
merge = Merge(Data1=mcol_3, Data2=mcol_5, Data3=mcol_2, Data4=mcol_6, Data5=mcol_4)  # disabled
mjoin_6 = MeshJoin(Meshes=merge)  # disabled
mesh_9 = Mesh(mjoin_6)  # disabled

# ----
geobottomcenter = GeoBottomCenter(geo=mesh)  # disabled
xy = XYPlane(Origin=pt)
dist = Distance(PointA=pt, PointB=pt_2)
timer = Timer(TimerInterval=500, Target=division)  # disabled

# ---- group: base cplane
pln = Plane(xy)

# ----
vec2pt = Vector2Pt(PointA=geobottomcenter, PointB=Point(0, 0, 0), Unitize=False)  # -> Vector, Length; disabled
move = Move(Geometry=mesh, Motion=vec2pt.Vector)  # -> Geometry, Transform; disabled

# ---- group: module meshes lego at orgin
mesh_10 = Mesh([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])

# ---- group: input method 1 - colortizer data
# Parsing Colortizer Data (CityMatrix 16x16)
panel = Panel("C:\Users\RYAN\Documents\GitHub\CityMatrix\Data\colortizer_data.txt")

# ---- group: colortizer data
file = ReadFile(File=panel, PerLineParse=True)

# ----
split = SplitList(List=file, Index=9)  # -> ListA, ListB
pshift = ShiftPaths(Data=split.ListB, Offset=-1)
pshift_2 = ShiftPaths(Data=split.ListA, Offset=-1)
item = ListItem(List=pshift_2, Index=4, Wrap=False)
item_2 = ListItem(List=pshift_2, Index=2, Wrap=False)
item_3 = ListItem(List=pshift_2, Index=3, Wrap=False)
item_4 = ListItem(List=pshift_2, Index=5, Wrap=False)
item_5 = ListItem(List=pshift_2, Index=6, Wrap=False)
item_6 = ListItem(List=pshift_2, Index=7, Wrap=False)
item_7 = ListItem(List=pshift_2, Index=1, Wrap=False)
item_8 = ListItem(List=pshift_2, Index=0, Wrap=False)
item_9 = ListItem(List=pshift_2, Index=8, Wrap=False)
split_2 = TextSplit(Text=item_2, Separators="\t")
split_3 = TextSplit(Text=item_3, Separators="\t")
split_4 = TextSplit(Text=item, Separators="\t")
split_5 = TextSplit(Text=item_4, Separators="\t")
split_6 = TextSplit(Text=item_5, Separators="\t")
split_7 = TextSplit(Text=item_6, Separators="\t")
split_8 = TextSplit(Text=item_7, Separators="\t")
split_9 = TextSplit(Text=item_8, Separators="\t")
split_10 = TextSplit(Text=item_9, Separators="\t")
pshift_3 = ShiftPaths(Data=split_4, Offset=1)
pshift_4 = ShiftPaths(Data=split_2, Offset=1)
pshift_5 = ShiftPaths(Data=split_3, Offset=1)
pshift_6 = ShiftPaths(Data=split_5, Offset=1)
pshift_7 = ShiftPaths(Data=split_6, Offset=1)
pshift_8 = ShiftPaths(Data=split_7, Offset=1)
pshift_9 = ShiftPaths(Data=split_8, Offset=1)
pshift_10 = ShiftPaths(Data=split_9, Offset=1)
pshift_11 = ShiftPaths(Data=split_10, Offset=1)
item_10 = ListItem(List=pshift_3, Index=0, Wrap=False)
item_11 = ListItem(List=pshift_4, Index=0, Wrap=False)
item_12 = ListItem(List=pshift_5, Index=0, Wrap=False)
item_13 = ListItem(List=pshift_6, Index=0, Wrap=False)
item_14 = ListItem(List=pshift_7, Index=0, Wrap=False)
item_15 = ListItem(List=pshift_8, Index=0, Wrap=False)
item_16 = ListItem(List=pshift_9, Index=0, Wrap=False)
item_17 = ListItem(List=pshift_10, Index=0, Wrap=False)
item_18 = ListItem(List=pshift_11, Index=0, Wrap=False)
txt = Text(item_10)
txt_2 = Text(item_11)
txt_3 = Text(item_12)
txt_4 = Text(item_13)
txt_5 = Text(item_14)
txt_6 = Text(item_15)
txt_7 = Text(item_16)
txt_8 = Text(item_17)
txt_9 = Text(item_18)
panel_2 = Panel(txt)
panel_3 = Panel(txt_2)
panel_4 = Panel(txt_3)
panel_5 = Panel(txt_4)
panel_6 = Panel(txt_5)
panel_7 = Panel(txt_6)
panel_8 = Panel(txt_7)
panel_9 = Panel(txt_8)
panel_10 = Panel(txt_9)
item_19 = ListItem(List=pshift_3, Index=1, Wrap=False)

# ---- group: dockRotation
int = Integer(item_19)

# ----
item_20 = ListItem(List=pshift_4, Index=1, Wrap=False)
item_21 = ListItem(List=pshift_5, Index=1, Wrap=False)

# ---- group: dockID
int_2 = Integer(item_21)

# ----
item_22 = ListItem(List=pshift_6, Index=1, Wrap=False)

# ---- group: slider1
num = Number(item_22)

# ----
item_23 = ListItem(List=pshift_7, Index=1, Wrap=False)

# ---- group: toggle1
bool = Boolean(item_23)

# ----
item_24 = ListItem(List=pshift_8, Index=1, Wrap=False)

# ---- group: toggle2
bool_2 = Boolean(item_24)

# ----
item_25 = ListItem(List=pshift_9, Index=1, Wrap=False)

# ---- group: gridExtent_x
int_3 = Integer(item_25)

# ----
division = Division(A=dist, B=int_3)

# ---- group: cell size
num_2 = Number(division)

# ----
item_26 = ListItem(List=pshift_10, Index=1, Wrap=False)
item_27 = ListItem(List=pshift_11, Index=1, Wrap=False)

# ---- group: toggle2
bool_3 = Boolean(item_27)

# ---- group: dockRotation
int_4 = Integer(item_19)

# ---- group: IDMax
int_5 = Integer(item_20)

# ---- group: dockID
int_6 = Integer(item_21)

# ---- group: slider1
num_3 = Number(item_22)

# ---- group: toggle1
bool_4 = Boolean(item_23)

# ---- group: toggle2
bool_5 = Boolean(item_24)

# ---- group: gridExtent_x
int_7 = Integer(item_25)

# ---- group: gridIndex
int_8 = Integer(item_26)

# ---- group: toggle2
bool_6 = Boolean(item_27)

# ----
panel_11 = Panel(int_4)
panel_12 = Panel(int_5)
panel_13 = Panel(int_6)
panel_14 = Panel(num_3)
panel_15 = Panel(bool_4)
panel_16 = Panel(bool_5)
panel_17 = Panel(int_7)
panel_18 = Panel(int_8)
panel_19 = Panel(bool_6)
item_28 = ListItem(List=pshift_9, Index=2, Wrap=False)

# ---- group: gridExtent_y
int_9 = Integer(item_28)

int_10 = Integer(item_28)

# ----
panel_20 = Panel(int_10)
multiplication = Multiplication(A=int_7, B=int_10)
split_11 = SplitList(List=pshift, Index=multiplication)  # -> ListA, ListB
pshift_12 = ShiftPaths(Data=split_11.ListA, Offset=-1)
split_12 = TextSplit(Text=pshift_12, Separators="\t")
pshift_13 = ShiftPaths(Data=split_12, Offset=1)

# ---- group: all data
int_11 = Integer(pshift_13)

# ----
panel_21 = Panel(int_11)
item_29 = ListItem(List=panel_21, Index="3", Wrap=False)
item_30 = ListItem(List=panel_21, Index="0", Wrap=False)
item_31 = ListItem(List=panel_21, Index="1", Wrap=False)
item_32 = ListItem(List=panel_21, Index="2", Wrap=False)
pshift_14 = ShiftPaths(Data=item_30, Offset=-1)
pshift_15 = ShiftPaths(Data=item_31, Offset=-1)
pshift_16 = ShiftPaths(Data=item_32, Offset=-1)
pshift_17 = ShiftPaths(Data=item_29, Offset=-1)

# ---- group: x
int_12 = Integer(pshift_15)

int_13 = Integer(int_12)

# ---- group: module id
int_14 = Integer(pshift_14)

int_15 = Integer(int_14)

# ----
item_33 = ListItem(List=mesh_10, Index=graft(int_15), Wrap=Toggle(True))
pshift_18 = ShiftPaths(Data=item_33, Offset=-1)

# ---- group: selected meshes
mesh_11 = Mesh(pshift_18)

# ---- group: y
int_16 = Integer(pshift_16)

int_17 = Integer(int_16)

# ----
modulecenter = ModuleCenter(pt=pt, num=num_2, int_2=int_13, int=int_17)  # -> pt_5, transform_2
xform = Transform(modulecenter.transform_2)

# ---- group: module center
pt_3 = Point(modulecenter.pt_5)

# ----
vec2pt_2 = Vector2Pt(PointA=Point(0, 0, 0), PointB=pt_3, Unitize=False)  # -> Vector, Length

# ---- group: delete and insert block, doesn't work
division_2 = Division(A=num_2, B=num_2)  # disabled
panel_22 = Panel("blockBake")  # disabled
bool_7 = Boolean(division_2)  # disabled
panel_23 = Panel("ttt")  # disabled
python = PythonScript(trigger=bool_7, name=panel_23)  # -> out, a; disabled
# ---------- python: Python ----------
import rhinoscriptsyntax as rs

if trigger:
    rs.Command("-selname ttt delete")

a = 0.0
# ---------- end python ----------
python_2 = PythonScript(trigger=bool_7, name=panel_23)  # -> out, a; disabled
# ---------- python_2: Python ----------
import rhinoscriptsyntax as rs
import scriptcontext
import Rhino
import time
scriptcontext.doc = Rhino.RhinoDoc.ActiveDoc
tb = rs.BlockInstances("module01_res_med")
if trigger:
    rs.EnableRedraw(False)
#    time.sleep(5)
#    rs.Command("-selname ttt delete")
#    for i in range(255):
#        tb = rs.BlockInstances("module01_res_med")
#        rs.ObjectName(tb, name)
#        rs.MoveObject(tb, [i,i,0.0])
#    rs.EnableRedraw(True)
a = 0.0

scriptcontext.doc = ghdoc
# ---------- end python_2 ----------
createatts = CreateAttributes(Name=panel_23, LayerName=panel_22, enableFullPath=False)  # disabled
panel_24 = Panel("module01_res_med")  # disabled
panel_25 = Panel("test_block_mesh")  # disabled
toggle = BooleanToggle(True)  # disabled
placeblock = PlaceBlock(BlockName=panel_24, Transform=xform, Bake=toggle, Attributes=createatts)  # disabled

# ---- group: rotation
int_18 = Integer(pshift_17)

int_19 = Integer(int_18)

# ----
rotate = Rotate(Geometry=mesh_11, Angle=degrees(int_19), Plane=PlaneXY(0, 0, 0))  # -> Geometry, Transform
move_2 = Move(Geometry=rotate.Geometry, Motion=vec2pt_2.Vector)  # -> Geometry, Transform

# ---- group: lego modules
mesh_12 = Mesh(move_2.Geometry)

# ----
panel_26 = Panel(int_12)
panel_27 = Panel(int_14)
panel_28 = Panel(int_16)
panel_29 = Panel(int_18)

# ---- group: total cell #
int_20 = Integer(multiplication)

# ----
panel_30 = Panel(int_20)

# ---- group: sticky rotations
python_3 = PythonScript(x=panel_29)  # -> out, rotations; inputs x: list
# ---------- python_3: Python ----------
"""
Realtime Simulator

written by Yan "Ryan" Zhang <ryanz@mit.edu>
for MIT Media Lab, Changing Place Group, CityScope Project
March.7th.2016
"""

import scriptcontext as sc

sc.sticky["rotations"] = x

rotations = sc.sticky["rotations"]
# ---------- end python_3 ----------

# ---- group: sticky y steps
python_4 = PythonScript(x=panel_28)  # -> out, ySteps; inputs x: list
# ---------- python_4: Python ----------
"""
Realtime Simulator

written by Yan "Ryan" Zhang <ryanz@mit.edu>
for MIT Media Lab, Changing Place Group, CityScope Project
March.7th.2016
"""

import scriptcontext as sc

sc.sticky["ySteps"] = x

ySteps = sc.sticky["ySteps"]
# ---------- end python_4 ----------

# ---- group: sticky moduleIDs
python_5 = PythonScript(x=panel_27)  # -> out, moduleIDs; inputs x: list
# ---------- python_5: Python ----------
"""
Realtime Simulator

written by Yan "Ryan" Zhang <ryanz@mit.edu>
for MIT Media Lab, Changing Place Group, CityScope Project
March.7th.2016
"""

import scriptcontext as sc

sc.sticky["moduleIDs"] = x

moduleIDs = sc.sticky["moduleIDs"]
# ---------- end python_5 ----------

# ---- group: sticky x steps
python_6 = PythonScript(x=panel_26)  # -> out, xSteps; inputs x: list
# ---------- python_6: Python ----------
"""
Realtime Simulator

written by Yan "Ryan" Zhang <ryanz@mit.edu>
for MIT Media Lab, Changing Place Group, CityScope Project
March.7th.2016
"""

import scriptcontext as sc

sc.sticky["xSteps"] = x

xSteps = sc.sticky["xSteps"]
# ---------- end python_6 ----------

# ----
panel_31 = Panel(python_3.rotations)
panel_32 = Panel(python_3.out)
panel_33 = Panel(python_4.ySteps)
panel_34 = Panel(python_4.out)
panel_35 = Panel(python_6.xSteps)
panel_36 = Panel(python_6.out)
panel_37 = Panel(python_5.moduleIDs)
panel_38 = Panel(python_5.out)

# ==== cluster ModuleCenter
pt = ClusterInput()
int = ClusterInput()
num = ClusterInput()
int_2 = ClusterInput()

# ---- group: y
int_3 = Integer(int)

# ---- group: cell size
num_2 = Number(num)

# ---- group: x
int_4 = Integer(int_2)

# ---- group: center
pt_2 = Point(pt)

# ----
pt_3 = ConstructPoint(XCoordinate=0, YCoordinate=0, ZCoordinate=0)
addition = Addition(A=int_4, B=0.5)
vec2pt = Vector2Pt(PointA=pt_3, PointB=pt_2, Unitize=False)  # -> Vector, Length
addition_2 = Addition(A=int_3, B=0.5)
multiplication = Multiplication(A=addition, B=num_2)
lng = ListLength(List=int_4)
move = Move(Motion=vec2pt.Vector)  # -> Geometry, Transform
multiplication_2 = Multiplication(A=addition_2, B=num_2)
X = UnitX(Factor=multiplication)
repeat = RepeatData(Data=move.Transform, Length=lng)
neg = Negative(Value=multiplication_2)
move_2 = Move(Geometry=pt_2, Motion=X)  # -> Geometry, Transform
graft = GraftTree(Tree=move_2.Transform, IncludeEmptyLists=True, IncludeNullItems=True)
Y = UnitY(Factor=neg)
pshift = ShiftPaths(Data=repeat, Offset=-1)
move_3 = Move(Geometry=move_2.Geometry, Motion=Y)  # -> Geometry, Transform
graft_2 = GraftTree(Tree=move_3.Transform, IncludeEmptyLists=True, IncludeNullItems=True)
comp = Compound(Transforms=[graft, graft_2])
graft_3 = GraftTree(Tree=pshift, IncludeEmptyLists=True, IncludeNullItems=True)
comp_2 = Compound(Transforms=[comp, graft_3])

# ---- group: module center
pt_4 = Point(move_3.Geometry)

# ----
pshift_2 = ShiftPaths(Data=comp_2, Offset=-1)
transform = Transform(pshift_2)
pt_5 = ClusterOutput(pt_4)
transform_2 = ClusterOutput(transform)

# ==== cluster GeoBottomCenter
geo = ClusterInput()
geo_2 = Geometry(geo)
bbox = BoundingBox(Content=geo_2, Plane=PlaneXY(0, 0, 0))  # -> Box, Box_2
box_corners = BoxCorners(Box=bbox.Box)  # -> CornerA, CornerB, CornerC, CornerD, CornerE, CornerF, CornerG, CornerH
pdecon = Deconstruct(Point=box_corners.CornerA)  # -> XComponent, YComponent, ZComponent
pdecon_2 = Deconstruct(Point=box_corners.CornerC)  # -> XComponent, YComponent, ZComponent
addition = Addition(A=pdecon.XComponent, B=pdecon_2.XComponent)
addition_2 = Addition(A=pdecon.YComponent, B=pdecon_2.YComponent)
division = Division(A=addition, B=2)
division_2 = Division(A=addition_2, B=2)
pt = ConstructPoint(XCoordinate=division, YCoordinate=division_2, ZCoordinate=pdecon.ZComponent)
pt_2 = Point(pt)
pt_3 = ClusterOutput(pt_2)
