# Grasshopper definition 160407_CityMatrix.gh (Grasshopper 0.9.76)
# plug-ins: Python Interpreter, horsterCameraControl, gHowl, HDTReference, LunchBox

subtraction = Subtraction(A="79", B=1)
subtraction_2 = Subtraction(A="30", B=1)
sqgrid = Square(Plane=PlaneXY(0, 0, 0), Size=1, ExtentX=subtraction, ExtentY=subtraction_2)  # -> Cells, Points
pdecon = Deconstruct(Point=sqgrid.Points)  # -> XComponent, YComponent, ZComponent
division = Division(A=pdecon.XComponent, B="79")
division_2 = Division(A=pdecon.YComponent, B="30")
pt = ConstructPoint(XCoordinate=division, YCoordinate=division_2, ZCoordinate=0)
ahsv = SplitAHSV(Colour=<missing>)  # -> Alpha, Hue, Saturation, Value
smaller = SmallerThan(FirstNumber=ahsv.Alpha, SecondNumber=1)  # -> SmallerThan, OrEqualTo
dispatch = Dispatch(List=sqgrid.Points, DispatchPattern=smaller.SmallerThan)  # -> ListA, ListB
dispatch_2 = Dispatch(List=<missing>, DispatchPattern=smaller.SmallerThan)  # -> ListA, ListB
vec = VectorXYZ(XComponent=2, YComponent=-2, ZComponent=-10)  # -> Vector, Length
col = Colour(flatten(dispatch_2.ListB))
planesrf = PlaneSurface(Plane=dispatch.ListB, XSize=Domain(-0.5, 0.5), YSize=Domain(-0.5, 0.5))
mesh = Mesh(flatten(planesrf))
mspray = MeshSpray(Mesh=graft(mesh), Points=Point(0, 0, 0), Colours=graft(col), SprayMode=0)
mjoin = MeshJoin(Meshes=flatten(mspray))
move = Move(Geometry=mjoin, Motion=vec.Vector)  # -> Geometry, Transform
mcol = MeshColours(Mesh=move.Geometry, Colours=RGB(0, 0, 0))
preview = CustomPreview(Geometry=planesrf, Shader=dispatch_2.ListB)
mjoin_2 = MeshJoin(Meshes=flatten([mjoin, mcol]))
toggle = BooleanToggle(False)
toggle_2 = BooleanToggle(False)  # disabled
swatch = ColourSwatch(SwatchColor=RGB(0, 0, 0))  # disabled
swatch_2 = ColourSwatch(SwatchColor=RGB(255, 115, 0))  # disabled

# ---- group: module meshes lego ref: 7 - J
mesh_2 = Mesh(<mesh referenced from the Rhino model>)

# ---- group: on screen mesh ref: 8 - X
mesh_3 = Mesh(<mesh referenced from the Rhino model>)  # disabled

# ---- group: module meshes lego ref: 8 - X
mesh_4 = Mesh(<mesh referenced from the Rhino model>)  # disabled

# ----
panel = Panel("7")  # disabled
mesh_5 = Mesh(<mesh referenced from the Rhino model>)  # disabled

# ---- group: on screen mesh ref: 7 - J
mesh_6 = Mesh(mjoin_2)

# ----
mcol_2 = MeshColours(Mesh=mesh_3, Colours=swatch_2)  # disabled
mcol_3 = MeshColours(Mesh=mesh_5, Colours=swatch)  # disabled
mjoin_3 = MeshJoin(Meshes=[mcol_2, mcol_3])  # disabled
number_slider = Slider(6.4, range=0..10)  # disabled
pt_2 = ConstructPoint(XCoordinate=500, YCoordinate=500, ZCoordinate=20)
pt_3 = Point(pt_2)
xy = XYPlane(Origin=pt_3)
number_slider_2 = Slider(0.01, range=0.001..1)  # disabled
movetoorgin = MoveToOrgin(G=mjoin_3, num=number_slider)  # disabled
movetoorgin_2 = MoveToOrgin(G=mesh_6, num=Slider(14.4, range=0..100))
orient = Orient(Geometry=movetoorgin_2, Source=PlaneXY(0, 0, 0), Target=xy)  # -> Geometry, Transform
scale = Scale(Geometry=orient.Geometry, Center=pt_3, Factor=Slider(0.81, range=0.001..101))  # -> Geometry, Transform
# 3D City Grid System
res_gray = ColourSwatch(SwatchColor=RGB(255, 255, 255))

# ---- group: mesh coloring
com_color = ColourSwatch(SwatchColor=RGB(255, 122, 122))
com_gray = ColourSwatch(SwatchColor=RGB(171, 171, 171))
res_color = ColourSwatch(SwatchColor=RGB(251, 255, 122))
mesh_7 = Mesh(<mesh referenced from the Rhino model>)
sidewalk = ColourSwatch(SwatchColor=RGB(107, 107, 107))
bikelane = ColourSwatch(SwatchColor=RGB(86, 135, 87))
res_gray_2 = ColourSwatch(SwatchColor=RGB(227, 227, 227))
parking = ColourSwatch(SwatchColor=RGB(196, 156, 100))
blank = ColourSwatch(SwatchColor=RGB(110, 110, 110))
road = ColourSwatch(SwatchColor=RGB(64, 64, 64))
park = ColourSwatch(SwatchColor=RGB(165, 201, 44))
text = ColourSwatch(SwatchColor=RGB(0, 0, 0))
mcol_4 = MeshColours(Mesh=mesh_7, Colours=com_color)
mesh_8 = Mesh(mcol_4)

# ---- group: shrink
cell_shrink = Slider(0.98, range=0.75..1)

# ----
movetoorgin_3 = MoveToOrgin(G=mesh_2, num=cell_shrink)
movetoorgin_4 = MoveToOrgin(G=mesh_4, num=cell_shrink)  # disabled

# ---- group: module meshes lego at orgin
mesh_9 = Mesh(movetoorgin_3)

mesh_10 = Mesh(movetoorgin_4)  # disabled

# ---- group: module meshes lego ref: -1
mesh_11 = Mesh(<mesh referenced from the Rhino model>)

# ---- group: module meshes lego ref: 0 to 5
mesh_12 = Mesh([<mesh referenced from the Rhino model> x6])

# ---- group: colortizer orgin
# CityMatrix
# 
# by Yan "Ryan" Zhang <ryanz@mit.edu>
# for MIT Media Lab, Changing Place Group, CityScope Project
# March.17th.2016
# LEGO Grid System
pt_4 = Point(<point referenced from the Rhino model>)

# ---- group: module meshes lego ref: 6 line bike
mesh_13 = Mesh(<mesh referenced from the Rhino model>)  # disabled

# ---- group: table size ref pt
pt_5 = Point(<point referenced from the Rhino model>)

# ---- group: module meshes lego ref: 6 line car
mesh_14 = Mesh(<mesh referenced from the Rhino model>)  # disabled

# ----
panel_2 = Panel("7002")  # disabled
# PEVs
panel_3 = Panel("127.0.0.1")  # disabled
pt_6 = Point([Point(906.25, 156.25, 0), Point(906.25, 531.25, 0), Point(906.25, 781.25, 0), Point(906.25, 656.25, 0), Point(906.25, 281.25, 0), Point(156.25, 906.25, 0)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])
crossings = Point([Point(156.25, 281.25, 0), Point(468.75, 281.25, 0), Point(718.75, 281.25, 0), Point(156.25, 656.25, 0), Point(468.75, 656.25, 0), Point(718.75, 656.25, 0), Point(906.25, 906.25, 0), Point(718.75, 906.25, 0), Point(468.75, 906.25, 0), Point(156.25, 906.25, 0), Point(906.25, 281.25, 0), Point(906.25, 656.25, 0), Point(906.25, 781.25, 0), Point(906.25, 531.25, 0), Point(906.25, 156.25, 0)])
_4_commed = Slider(6, range=1..25)
_1_resmed = Slider(4, range=1..25)
_3_comhq = Slider(3, range=1..25)
_0_reslux = Slider(1, range=1..25)
_2_resmu = Slider(20, range=1..25)
_5_rescw = Slider(20, range=1..25)

# ---- group: 3D building site move amount
X = UnitX(Factor="10000")

# ----
swatch_3 = ColourSwatch(SwatchColor=RGB(255, 255, 255))  # disabled
panel_4 = Panel("C:\Users\RYAN\Documents\GitHub\CityMatrix\Map\PEV_PSG AND PKG_300DPI.png")  # disabled
panel_5 = Panel("0.01")  # disabled
mesh_15 = Mesh(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)  # disabled
xy_2 = XYPlane(Origin=pt_4)
dist = Distance(PointA=pt_4, PointB=pt_5)
timer = Timer(TimerInterval=500, Target=division_3)  # disabled

# ---- group: 6 intersect bike
mesh_16 = Mesh(<mesh referenced from the Rhino model>)  # disabled

# ---- group: 6 intersect car
mesh_17 = Mesh(<mesh referenced from the Rhino model>)  # disabled

# ---- group: udp receiver
udp = UDPReceiver(Address=panel_3, Port=panel_2, Pattern=0)  # -> Info, Data; disabled

# ----
com = ColourSwatch(SwatchColor=RGB(158, 158, 158))
com_2 = ColourSwatch(SwatchColor=RGB(71, 71, 71))

# ---- group: ref mesh
# Traffic Heatmap - Yasushi
mesh_18 = Mesh(<mesh referenced from the Rhino model>)

# ----
res = ColourSwatch(SwatchColor=RGB(212, 212, 212))
res_2 = ColourSwatch(SwatchColor=RGB(76, 76, 76))

# ---- group: private car / road quator 0s
mesh_19 = Mesh([<mesh referenced from the Rhino model> x4])
pt_7 = Point(<point referenced from the Rhino model>)

# ---- group: base cplane
pln = Plane(xy_2)

# ----
movetoorgin_5 = MoveToOrgin(G=mesh_11, num=cell_shrink)
movetoorgin_6 = MoveToOrgin(G=mesh_12, num=cell_shrink)
vec_2 = Vector(X)
split = TextSplit(Text=udp.Data)  # disabled

# ---- group: PEV center pt
pt_8 = Point(split)  # disabled

# ----
vec2pt = Vector2Pt(PointA=Point(0, 0, 0), PointB=pt_8, Unitize=False)  # -> Vector, Length; disabled
move_2 = Move(Geometry=mesh_15, Motion=vec2pt.Vector)  # -> Geometry, Transform; disabled
mjoin_4 = MeshJoin(Meshes=move_2.Geometry)  # disabled
srf = Surface(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)
movetoorgin_7 = MoveToOrgin(G=mesh_18, num=cell_shrink)

# ---- group: private car / road quator 1s
mesh_20 = Mesh([<mesh referenced from the Rhino model> x4])
pt_9 = Point(<point referenced from the Rhino model>)

# ---- group: private car
scale_nu = ScaleNU(Geometry=mesh_19, Plane=pt_7, ScaleX=cell_shrink, ScaleY=cell_shrink, ScaleZ=1)  # -> Geometry, Transform
scale_nu_2 = ScaleNU(Geometry=mesh_20, Plane=pt_9, ScaleX=cell_shrink, ScaleY=cell_shrink, ScaleZ=1)  # -> Geometry, Transform

# ----
merge = Merge(Data1=res, Data2=res, Data3=res, Data4=com, Data5=com, Data6=com)
merge_2 = Merge(Data1=res_2, Data2=res_2, Data3=res_2, Data4=com_2, Data5=com_2, Data6=com_2)

# ---- group: PEVs
previewmat = CustomPreviewMaterials(Geometry=mjoin_4, DiffuseColor=swatch_3, Transparency=panel_5, DiffuseBitmap=panel_4)  # disabled

# ---- group: module meshes lego at orgin
mesh_21 = Mesh(movetoorgin_6)

mesh_22 = Mesh(movetoorgin_5)

# ----
merge_3 = Merge(Data1=merge, Data2=merge_2)

# ---- group: PEV / road quator 0s
mesh_23 = Mesh([<mesh referenced from the Rhino model> x4])
pt_10 = Point(<point referenced from the Rhino model>)

# ----
pshift = ShiftPaths(Data=movetoorgin_7, Offset=-1)

# ---- group: color for each type
col_2 = Colour(merge_3)

# ---- group: floor height
panel_6 = Panel("3.5")

# ---- group: PEV / road quator 1s
mesh_24 = Mesh([<mesh referenced from the Rhino model> x4])
pt_11 = Point(<point referenced from the Rhino model>)

# ---- group: PEV
scale_nu_3 = ScaleNU(Geometry=mesh_23, Plane=pt_10, ScaleX=cell_shrink, ScaleY=cell_shrink, ScaleZ=1)  # -> Geometry, Transform
scale_nu_4 = ScaleNU(Geometry=mesh_24, Plane=pt_11, ScaleX=cell_shrink, ScaleY=cell_shrink, ScaleZ=1)  # -> Geometry, Transform

# ---- group: ref mesh at orgin
mesh_25 = Mesh(pshift)

# ----
move_3 = Move(Geometry=mesh_25, Motion=pt_6)  # -> Geometry, Transform

# ---- group: base height
panel_7 = Panel("5.0")

# ----
panel_8 = Panel("8")  # disabled
Z = UnitZ(Factor=Slider(4.9, range=0..10))

# ---- group: translate example
pt_12 = Point(Point(-15, -8, 0))  # disabled
python = PythonScript(point=pt_12)  # -> out, output; inputs point: Point3d; disabled
# ---------- python: Python ----------
import Rhino

transform = Rhino.Geometry.Transform.Translation(0,0,5)
point.Transform(transform)

output = point
# ---------- end python ----------

# ----
move_4 = Move(Geometry=move_3.Geometry, Motion=Z)  # -> Geometry, Transform
graft = GraftTree(Tree=move_4.Geometry, IncludeEmptyLists=True, IncludeNullItems=True)
move_5 = Move(Geometry=move_4.Geometry, Motion=vec_2)  # -> Geometry, Transform
graft_2 = GraftTree(Tree=move_5.Geometry, IncludeEmptyLists=True, IncludeNullItems=True)
number_slider_3 = Slider(10, range=10..100)
panel_9 = Panel("C:\Users\RYAN\Documents\GitHub\CityMatrix\Data\colortizer_data_rhino_02_YZ.txt")
panel_10 = Panel("C:\Users\RYAN\Documents\GitHub\CityMatrix\Data\colortizer_data_sample.txt")
# Parsing Colortizer Data (CityMatrix 16x16)
panel_11 = Panel("C:\Users\RYAN\Documents\GitHub\CityMatrix\Data\colortizer_data.txt")
panel_12 = Panel("C:\Users\RYAN\Documents\GitHub\CityMatrix\Data\colortizer_data_03_YZ.txt")

# ---- group: meshes lego ref: parking
mesh_26 = Mesh(<mesh referenced from the Rhino model>)

# ----
panel_13 = Panel("C:\Users\RYAN\Documents\GitHub\CityMatrix\Data\colortizer_data_rhino_01_YZ.txt")

# ---- group: meshes lego ref: park
mesh_27 = Mesh(<mesh referenced from the Rhino model>)

# ----
Z_2 = UnitZ(Factor=number_slider_3)
msphereex = MeshSphereEx(Base=Z_2, Radius=number_slider_3, Count=Slider(5, range=0..10))
Z_3 = UnitZ(Factor=Slider(6, range=0..10))
movetoorgin_8 = MoveToOrgin(G=mesh_26, num=cell_shrink)
movetoorgin_9 = MoveToOrgin(G=mesh_27, num=cell_shrink)
move_6 = Move(Geometry=msphereex, Motion=Z_3)  # -> Geometry, Transform

# ---- group: udp receiver
udp_2 = UDPReceiver(Address="127.0.0.1", Port="7001", Pattern=0)  # -> Info, Data

# ----
tree_scale = Slider(0.81, range=0.5..2)
mcol_5 = MeshColours(Mesh=move_6.Geometry, Colours=park)
split_2 = TextSplit(Text=udp_2.Data)

# ---- group: module meshes lego at orgin
mesh_28 = Mesh(movetoorgin_8)

# ---- group: reading txt
file = ReadFile(File=panel_12, PerLineParse=True)

# ---- group: module meshes lego at orgin
mesh_29 = Mesh(movetoorgin_9)

# ----
shift = ShiftList(List=split_2, Shift=1, Wrap=False)

# ---- group: meshes 3D ref: Tree
mesh_30 = Mesh(mcol_5)

# ---- group: overwrite toggle 1 - trans mode
transportation_mode = BooleanToggle(False)

# ----
txt = Text(file)
txt_2 = Text(shift)

# ---- group: 3D building site move amount
vec_3 = Vector(X)

# ----
tree = Slider(2.13, range=0..5)

# ---- group: colortizer data
txt_3 = Text(txt_2)

# ----
panel_14 = Panel(txt_3)

# ---- group: parking cell #
parking_cell = Slider(18, range=0..50)

# ---- group: total parking cell number
# Parking & Park
int = Integer(parking_cell)

# ----
split_3 = SplitList(List=txt_3, Index=9)  # -> ListA, ListB
multiplication = Multiplication(A="3", B=tree)
multiplication_2 = Multiplication(A="3", B=tree)
dom = ConstructDomain(DomainStart=multiplication, DomainEnd=multiplication_2)
pt_13 = Point(<point referenced from the Rhino model>)

# ---- group: park cell #
park_cell = Slider(33, range=0..50)

# ---- group: total park cell number
int_2 = Integer(park_cell)

# ----
pshift_2 = ShiftPaths(Data=split_3.ListB, Offset=-1)
pshift_3 = ShiftPaths(Data=split_3.ListA, Offset=-1)
item = ListItem(List=pshift_3, Index=4, Wrap=False)
item_2 = ListItem(List=pshift_3, Index=2, Wrap=False)
item_3 = ListItem(List=pshift_3, Index=3, Wrap=False)
item_4 = ListItem(List=txt_3, Index=265, Wrap=False)
item_5 = ListItem(List=pshift_3, Index=5, Wrap=False)
item_6 = ListItem(List=pshift_3, Index=6, Wrap=False)
item_7 = ListItem(List=pshift_3, Index=7, Wrap=False)
item_8 = ListItem(List=pshift_3, Index=1, Wrap=False)
item_9 = ListItem(List=pshift_3, Index=0, Wrap=False)
item_10 = ListItem(List=pshift_3, Index=8, Wrap=False)
split_4 = TextSplit(Text=item, Separators="\t")
split_5 = TextSplit(Text=item_2, Separators="\t")
split_6 = TextSplit(Text=item_3, Separators="\t")
split_7 = TextSplit(Text=item_4, Separators="\t")
split_8 = TextSplit(Text=item_5, Separators="\t")
split_9 = TextSplit(Text=item_6, Separators="\t")
split_10 = TextSplit(Text=item_7, Separators="\t")
split_11 = TextSplit(Text=item_8, Separators="\t")
split_12 = TextSplit(Text=item_9, Separators="\t")
split_13 = TextSplit(Text=item_10, Separators="\t")
pshift_4 = ShiftPaths(Data=split_4, Offset=1)
pshift_5 = ShiftPaths(Data=split_5, Offset=1)
pshift_6 = ShiftPaths(Data=split_6, Offset=1)
pshift_7 = ShiftPaths(Data=split_7, Offset=1)
pshift_8 = ShiftPaths(Data=split_8, Offset=1)
pshift_9 = ShiftPaths(Data=split_9, Offset=1)
pshift_10 = ShiftPaths(Data=split_10, Offset=1)
pshift_11 = ShiftPaths(Data=split_11, Offset=1)
pshift_12 = ShiftPaths(Data=split_12, Offset=1)
pshift_13 = ShiftPaths(Data=split_13, Offset=1)
total_ppl = Slider(28269, range=700..30000)
number_slider_4 = Slider(19.1, range=0..100)
txt_4 = Text(pshift_7)
item_11 = ListItem(List=pshift_4, Index=0, Wrap=False)
item_12 = ListItem(List=pshift_5, Index=0, Wrap=False)
item_13 = ListItem(List=pshift_6, Index=0, Wrap=False)
item_14 = ListItem(List=pshift_8, Index=0, Wrap=False)
item_15 = ListItem(List=pshift_9, Index=0, Wrap=False)
item_16 = ListItem(List=pshift_10, Index=0, Wrap=False)
item_17 = ListItem(List=pshift_11, Index=0, Wrap=False)
item_18 = ListItem(List=pshift_12, Index=0, Wrap=False)
item_19 = ListItem(List=pshift_13, Index=0, Wrap=False)
range = Range(Domain="1 to 30", Steps=100)
panel_15 = Panel(txt_4)
txt_5 = Text(item_11)
txt_6 = Text(item_12)
txt_7 = Text(item_13)
txt_8 = Text(item_14)
txt_9 = Text(item_15)
txt_10 = Text(item_16)
txt_11 = Text(item_17)
txt_12 = Text(item_18)
txt_13 = Text(item_19)
int_3 = Integer(range)
pt_14 = Point(<point referenced from the Rhino model>)
panel_16 = Panel(txt_5)
panel_17 = Panel(txt_6)
panel_18 = Panel(txt_7)
panel_19 = Panel(txt_8)
panel_20 = Panel(txt_9)
panel_21 = Panel(txt_10)
panel_22 = Panel(txt_11)
panel_23 = Panel(txt_12)
panel_24 = Panel(txt_13)
txt_14 = Text(int_3)
txt_15 = Text(["Luxury", "Normal", "Micro-unit", "Head Quater", "Normal", "Co-working"])
txt_16 = Text(["Residential", "Residential", "Residential", "Office", "Office", "Office"])
txt_17 = Text(["Private Car", "Mobility on Demand"])
item_20 = ListItem(List=panel_15, Index=0, Wrap=False)
item_21 = ListItem(List=panel_15, Index=1, Wrap=False)
item_22 = ListItem(List=panel_15, Index=2, Wrap=False)
item_23 = ListItem(List=panel_15, Index=4, Wrap=False)
item_24 = ListItem(List=panel_15, Index=5, Wrap=False)
item_25 = ListItem(List=panel_15, Index=3, Wrap=False)
number_slider_5 = Slider(15.2, range=0..100)
int_4 = Integer(item_20)
int_5 = Integer(int_4)
int_6 = Integer(item_21)
int_7 = Integer(int_6)
int_8 = Integer(item_22)
int_9 = Integer(int_8)
int_10 = Integer(item_25)
int_11 = Integer(int_10)
int_12 = Integer(item_23)
int_13 = Integer(int_12)
int_14 = Integer(item_24)
int_15 = Integer(int_14)
merge_4 = Merge(Data1=int_5, Data2=int_7, Data3=int_9, Data4=int_11, Data5=int_13, Data6=int_15)

# ---- group: all fl #s
txt_18 = Text([int_5, int_7, int_9, int_11, int_13, int_15])

# ---- group: floor num for each type
int_16 = Integer(merge_4)

# ----
multiplication_3 = Multiplication(A=int_16, B=panel_6)

# ---- group: building height for each type
num = Number(multiplication_3)

# ----
panel_25 = Panel(num)
item_26 = ListItem(List=pshift_4, Index=1, Wrap=False)

# ---- group: dockRotation
int_17 = Integer(item_26)

int_18 = Integer(item_26)

# ----
item_27 = ListItem(List=pshift_5, Index=1, Wrap=False)
item_28 = ListItem(List=pshift_6, Index=1, Wrap=False)

# ---- group: dockID
int_19 = Integer(item_28)

int_20 = Integer(item_28)

# ----
item_29 = ListItem(List=pshift_8, Index=1, Wrap=False)

# ---- group: slider1
num_2 = Number(item_29)

num_3 = Number(item_29)

# ----
item_30 = ListItem(List=pshift_9, Index=1, Wrap=False)

# ---- group: toggle1
bool = Boolean(item_30)

bool_2 = Boolean(item_30)

# ----
panel_26 = Panel(bool_2)

# ---- group: toggle1
bool_3 = Boolean(panel_26)

# ---- group: traffic mode is PEV
bool_4 = Boolean(bool_3)

# ---- group: toggle1
bool_5 = Boolean(bool_3)

# ----
filter = StreamFilter(Gate=bool_5, Stream0=scale_nu.Geometry, Stream1=scale_nu_3.Geometry)
filter_2 = StreamFilter(Gate=bool_5, Stream0=scale_nu_2.Geometry, Stream1=scale_nu_4.Geometry)
mesh_31 = Mesh(filter_2)
mesh_32 = Mesh(filter)
filter_3 = StreamFilter(Gate=bool_5, Stream0=pt_7, Stream1=pt_10)
filter_4 = StreamFilter(Gate=bool_5, Stream0=pt_9, Stream1=pt_11)
pt_15 = Point(filter_4)
pt_16 = Point(filter_3)
item_31 = ListItem(List=pshift_10, Index=1, Wrap=False)

# ---- group: toggle2
bool_6 = Boolean(item_31)

bool_7 = Boolean(item_31)

# ----
swatch_4 = ColourSwatch(SwatchColor=RGB(201, 201, 201))
item_32 = ListItem(List=pshift_11, Index=1, Wrap=False)

# ---- group: gridExtent_x
int_21 = Integer(item_32)

int_22 = Integer(item_32)

# ----
division_3 = Division(A=dist, B=int_21)

# ---- group: cell size
num_4 = Number(division_3)

num_5 = Number(division_3)

# ----
division_4 = Division(A=num_5, B=2)
multiplication_4 = Multiplication(A=division_4, B=Slider(0.95, range=0..1))
neg = Negative(Value=multiplication_4)
dom_2 = ConstructDomain(DomainStart=neg, DomainEnd=multiplication_4)
multiplication_5 = Multiplication(A=panel_8, B=num_4)  # disabled
pt_17 = ConstructPoint(XCoordinate=multiplication_5, YCoordinate=0, ZCoordinate=0)  # disabled
yz = YZPlane(Origin=pt_17)  # disabled
mirror = Mirror(Geometry=move_4.Geometry, Plane=yz)  # -> Geometry, Transform; disabled

# ---- group: gridExtent_x
# Dashboard
int_23 = Integer(item_32)

# ---- group: cell size
num_6 = Number(division_3)

# ----
division_5 = Division(A=num_6, B=2.5)
division_6 = Division(A=num_5, B=2)
neg_2 = Negative(Value=division_5)

# ---- group: cell area
sqr = Square(Value=num_5)

# ----
multiplication_6 = Multiplication(A=sqr, B=Slider(0.25, range=0..1))
num_7 = Number(multiplication_6)
dom_3 = ConstructDomain(DomainStart=neg_2, DomainEnd=division_5)

# ---- group: ppl per m2
multiplication_7 = Multiplication(A=num_7, B="0.018181")
multiplication_8 = Multiplication(A=num_7, B="0.05454")
multiplication_9 = Multiplication(A=num_7, B="0.0666667")
multiplication_10 = Multiplication(A=num_7, B="0.01123")
multiplication_11 = Multiplication(A=num_7, B="0.2")
multiplication_12 = Multiplication(A=num_7, B="0.0337")

# ----
panel_27 = Panel(multiplication_7)
panel_28 = Panel(multiplication_10)
panel_29 = Panel(multiplication_9)
panel_30 = Panel(multiplication_12)
panel_31 = Panel(multiplication_8)
panel_32 = Panel(multiplication_11)
item_33 = ListItem(List=pshift_12, Index=1, Wrap=False)
item_34 = ListItem(List=pshift_13, Index=1, Wrap=False)

# ---- group: toggle2
bool_8 = Boolean(item_34)

bool_9 = Boolean(item_34)

# ----
pt_18 = Point(<point referenced from the Rhino model>)
pt_19 = Point(<point referenced from the Rhino model>)
pt_20 = Point(<point referenced from the Rhino model>)
pt_21 = Point(<point referenced from the Rhino model>)

# ---- group: dockRotation
int_24 = Integer(item_26)

# ---- group: IDMax
int_25 = Integer(item_27)

# ---- group: dockID
int_26 = Integer(item_28)

# ----
item_35 = ListItem(List=txt_15, Index=int_26, Wrap=False)
item_36 = ListItem(List=txt_16, Index=int_26, Wrap=False)

# ---- group: slider1
num_8 = Number(item_29)

num_9 = Number(num_8)

# ----
multiplication_13 = Multiplication(A=num_9, B=100)
int_27 = Integer(multiplication_13)
item_37 = ListItem(List=txt_14, Index=int_27, Wrap=True)

# ---- group: toggle1
bool_10 = Boolean(item_30)

# ----
item_38 = ListItem(List=txt_17, Index=bool_10, Wrap=True)

# ---- group: toggle2
bool_11 = Boolean(item_31)

# ---- group: gridExtent_x
int_28 = Integer(item_32)

# ---- group: gridIndex
int_29 = Integer(item_33)

# ---- group: toggle2
bool_12 = Boolean(item_34)

# ---- group: office list
tag = TextTag3D(Location=pt_18, Text=item_35, Size=number_slider_5, Colour=swatch_4, Justification=5)

# ----
panel_33 = Panel(int_24)
panel_34 = Panel(int_25)
panel_35 = Panel(int_26)
panel_36 = Panel(num_8)
panel_37 = Panel(bool_10)
panel_38 = Panel(bool_11)

# ---- group: fl # slider
tag_2 = TextTag3D(Location=pt_19, Text=item_37, Size=number_slider_5, Colour=swatch_4, Justification=8)

# ----
panel_39 = Panel(int_28)

# ---- group: residential list
tag_3 = TextTag3D(Location=pt_20, Text=item_36, Size=number_slider_5, Colour=swatch_4, Justification=5)

# ----
panel_40 = Panel(int_29)

# ---- group: transportation mode
tag_4 = TextTag3D(Location=pt_21, Text=item_38, Size=number_slider_5, Colour=swatch_4, Justification=5)

# ----
panel_41 = Panel(bool_12)
number_slider_6 = Slider(11.8, range=0..100)
item_39 = ListItem(List=pshift_11, Index=2, Wrap=False)

# ---- group: gridExtent_y
int_30 = Integer(item_39)

int_31 = Integer(item_39)

int_32 = Integer(item_39)

int_33 = Integer(item_39)

# ----
pt_22 = Point(<point referenced from the Rhino model>)
item_40 = ListItem(List=mesh_21, Index=int_26, Wrap=False)
pt_23 = Point(<point referenced from the Rhino model>)
neg_3 = Negative(Value=int_24)
panel_42 = Panel(int_33)
subtraction_3 = Subtraction(A=int_28, B=1)
rotate = Rotate(Geometry=item_40, Angle=degrees(neg_3), Plane=PlaneXY(0, 0, 0))  # -> Geometry, Transform
vec2pt_2 = Vector2Pt(PointA=Point(0, 0, 0), PointB=pt_23, Unitize=False)  # -> Vector, Length
multiplication_14 = Multiplication(A=int_28, B=int_33)
split_14 = SplitList(List=pshift_2, Index=multiplication_14)  # -> ListA, ListB
pshift_14 = ShiftPaths(Data=split_14.ListA, Offset=-1)
split_15 = TextSplit(Text=pshift_14, Separators="\t")
pshift_15 = ShiftPaths(Data=split_15, Offset=1)

# ---- group: all data
int_34 = Integer(pshift_15)

# ----
panel_43 = Panel(int_34)
item_41 = ListItem(List=int_34, Index="3", Wrap=False)
item_42 = ListItem(List=int_34, Index="0", Wrap=False)
item_43 = ListItem(List=int_34, Index="1", Wrap=False)
item_44 = ListItem(List=int_34, Index="2", Wrap=False)
pshift_16 = ShiftPaths(Data=item_42, Offset=-1)
pshift_17 = ShiftPaths(Data=item_43, Offset=-1)
pshift_18 = ShiftPaths(Data=item_44, Offset=-1)
pshift_19 = ShiftPaths(Data=item_41, Offset=-1)
neg_4 = Negative(Value=pshift_19)

# ---- group: module id
int_35 = Integer(pshift_16)

int_36 = Integer(int_35)

int_37 = Integer(int_35)

# ----
equals = Equality(FirstNumber=int_37, SecondNumber=panel)  # -> Equality, Inequality; disabled
int_38 = Integer(equals.Equality)  # disabled
ma = MassAddition(Input=int_38)  # -> Result, PartialResults; disabled
larger = LargerThan(FirstNumber=ma.Result, SecondNumber=0)  # -> LargerThan, OrEqualTo; disabled
equals_2 = Equality(FirstNumber=int_37, SecondNumber="7")  # -> Equality, Inequality
int_39 = Integer(equals_2.Equality)
ma_2 = MassAddition(Input=int_39)  # -> Result, PartialResults
larger_2 = LargerThan(FirstNumber=ma_2.Result, SecondNumber=0)  # -> LargerThan, OrEqualTo

# ---- group: if has this special id
bool_13 = Boolean(larger.LargerThan)  # disabled

bool_14 = Boolean(bool_13)  # disabled

# ----
getcamera = GetCamera(GetCamera=bool_14)  # -> Location, Target, LensLength, UpDirection; disabled
ln = Line(StartPoint=getcamera.Location, EndPoint=getcamera.Target)  # disabled
getplanefrom2pts = GetPlaneFrom2pts(pt_2=getcamera.Location, pt=getcamera.Target)  # disabled

# ---- group: if has this special id
bool_15 = Boolean(larger_2.LargerThan)

bool_16 = Boolean(bool_15)

# ----
getcamera_2 = GetCamera(GetCamera=bool_16)  # -> Location, Target, LensLength, UpDirection
ln_2 = Line(StartPoint=getcamera_2.Location, EndPoint=getcamera_2.Target)
getplanefrom2pts_2 = GetPlaneFrom2pts(pt_2=getcamera_2.Location, pt=getcamera_2.Target)

# ---- group: current cam canvas pln
pln_2 = Plane(getplanefrom2pts)  # disabled

pln_3 = Plane(getplanefrom2pts_2)

# ----
orient_2 = Orient(Geometry=movetoorgin, Source=PlaneXY(0, 0, 0), Target=pln_2)  # -> Geometry, Transform; disabled
orient_3 = Orient(Geometry=movetoorgin_2, Source=PlaneXY(0, 0, 0), Target=pln_3)  # -> Geometry, Transform
scale_2 = Scale(Geometry=orient_2.Geometry, Center=getcamera.Location, Factor=number_slider_2)  # -> Geometry, Transform; disabled
scale_3 = Scale(Geometry=orient_3.Geometry, Center=getcamera_2.Location, Factor=Slider(0.01, range=0.001..1))  # -> Geometry, Transform
filter_5 = StreamFilter(Gate=bool_14, Stream1=scale_2.Geometry)  # disabled
filter_6 = StreamFilter(Gate=bool_16, Stream1=scale_3.Geometry)
filter_7 = StreamFilter(Gate=bool_16, Stream1=scale.Geometry)

# ---- group: on 3d view
mesh_33 = Mesh(filter_5)  # disabled

mesh_34 = Mesh(filter_6)

# ---- group: on lego
mesh_35 = Mesh(filter_7)

# ----
larger_3 = LargerThan(FirstNumber=int_36, SecondNumber="0")  # -> LargerThan, OrEqualTo
smaller_2 = SmallerThan(FirstNumber=int_36, SecondNumber="5")  # -> SmallerThan, OrEqualTo
and = GateAnd(A=larger_3.OrEqualTo, B=smaller_2.OrEqualTo)

# ---- group: is building or not
bool_17 = Boolean(and)

# ----
dispatch_3 = Dispatch(List=int_36, DispatchPattern=bool_17)  # -> ListA, ListB

# ---- group: building id
int_40 = Integer(dispatch_3.ListA)

# ----
larger_4 = LargerThan(FirstNumber=int_37, SecondNumber="0")  # -> LargerThan, OrEqualTo
smaller_3 = SmallerThan(FirstNumber=int_37, SecondNumber="5")  # -> SmallerThan, OrEqualTo
and_2 = GateAnd(A=larger_4.OrEqualTo, B=smaller_3.OrEqualTo)
dispatch_4 = Dispatch(List=int_37, DispatchPattern=and_2)  # -> ListA, ListB
smaller_4 = SmallerThan(FirstNumber=int_37, SecondNumber="0")  # -> SmallerThan, OrEqualTo
item_45 = ListItem(List=mesh_21, Index=graft(dispatch_4.ListA), Wrap=False)
item_46 = ListItem(List=panel_25, Index=graft(int_40), Wrap=False)
pshift_20 = ShiftPaths(Data=item_45, Offset=-1)
pshift_21 = ShiftPaths(Data=item_46, Offset=-1)

# ---- group: building height of each building
num_10 = Number(pshift_21)

# ----
addition = Addition(A=num_10, B=panel_7)
dom_4 = ConstructDomain(DomainStart=0, DomainEnd=addition)
equals_3 = Equality(FirstNumber=int_37, SecondNumber="7")  # -> Equality, Inequality
equals_4 = Equality(FirstNumber=int_37, SecondNumber="6")  # -> Equality, Inequality
or = GateOr(A=equals_4.Equality, B=equals_3.Equality)

# ---- group: module id
int_41 = Integer(int_35)

# ----
equals_5 = Equality(FirstNumber=int_41, SecondNumber="0")  # -> Equality, Inequality
equals_6 = Equality(FirstNumber=int_41, SecondNumber="1")  # -> Equality, Inequality
equals_7 = Equality(FirstNumber=int_41, SecondNumber="3")  # -> Equality, Inequality
equals_8 = Equality(FirstNumber=int_41, SecondNumber="2")  # -> Equality, Inequality
equals_9 = Equality(FirstNumber=int_41, SecondNumber="4")  # -> Equality, Inequality
equals_10 = Equality(FirstNumber=int_41, SecondNumber="5")  # -> Equality, Inequality
int_42 = Integer(equals_5.Equality)
int_43 = Integer(equals_6.Equality)
int_44 = Integer(equals_7.Equality)
int_45 = Integer(equals_8.Equality)
int_46 = Integer(equals_9.Equality)
int_47 = Integer(equals_10.Equality)
ma_3 = MassAddition(Input=int_42)  # -> Result, PartialResults
ma_4 = MassAddition(Input=int_43)  # -> Result, PartialResults
ma_5 = MassAddition(Input=int_44)  # -> Result, PartialResults
ma_6 = MassAddition(Input=int_45)  # -> Result, PartialResults
ma_7 = MassAddition(Input=int_46)  # -> Result, PartialResults
ma_8 = MassAddition(Input=int_47)  # -> Result, PartialResults
int_48 = Integer(ma_3.Result)
panel_44 = Panel(int_48)
int_49 = Integer(ma_4.Result)
panel_45 = Panel(int_49)
int_50 = Integer(ma_5.Result)
panel_46 = Panel(int_50)
int_51 = Integer(ma_6.Result)
panel_47 = Panel(int_51)
int_52 = Integer(ma_7.Result)
panel_48 = Panel(int_52)
int_53 = Integer(ma_8.Result)
panel_49 = Panel(int_53)

# ---- group: Micro-unit Building #
int_54 = Integer(int_51)

# ---- group: Regular residential Building #
int_55 = Integer(int_49)

# ---- group: Luxury Building #
int_56 = Integer(int_48)

# ---- group: Head Quater Building #
int_57 = Integer(int_50)

# ---- group: Regular Office Building #
int_58 = Integer(int_52)

# ---- group: Co-working Building #
int_59 = Integer(int_53)

# ----
multiplication_15 = Multiplication(A=int_13, B=int_58)
multiplication_16 = Multiplication(A=int_7, B=int_55)
multiplication_17 = Multiplication(A=int_15, B=int_59)
multiplication_18 = Multiplication(A=int_9, B=int_54)
multiplication_19 = Multiplication(A=int_11, B=int_57)
multiplication_20 = Multiplication(A=int_5, B=int_56)

multiplication_21 = Multiplication(A=panel_31, B=multiplication_15)
multiplication_22 = Multiplication(A=panel_27, B=multiplication_16)
multiplication_23 = Multiplication(A=panel_32, B=multiplication_17)
multiplication_24 = Multiplication(A=panel_29, B=multiplication_18)
multiplication_25 = Multiplication(A=panel_30, B=multiplication_19)
multiplication_26 = Multiplication(A=panel_28, B=multiplication_20)

# ---- group: Head Quater ppl #
int_60 = Integer(multiplication_25)

# ---- group: Co-working ppl #
int_61 = Integer(multiplication_23)

# ---- group: Micro-unit ppl #
int_62 = Integer(multiplication_24)

# ---- group: Luxury ppl #
int_63 = Integer(multiplication_26)

# ---- group: Regular residential ppl #
int_64 = Integer(multiplication_22)

# ---- group: Regular Office ppl #
int_65 = Integer(multiplication_21)

# ----
join = TextJoin(Text=flatten([" - Regular: ", int_64]))
join_2 = TextJoin(Text=flatten([" - Micro-unit: ", int_62]))
join_3 = TextJoin(Text=flatten([" - Luxury: ", int_63]))
ma_9 = MassAddition(Input=[int_61, int_65, int_60])  # -> Result, PartialResults
ma_10 = MassAddition(Input=[int_62, int_64, int_63])  # -> Result, PartialResults

# ---- group: total working ppl #
int_66 = Integer(ma_9.Result)

# ---- group: total residential ppl #
int_67 = Integer(ma_10.Result)

# ----
join_4 = TextJoin(Text=flatten(["Residential: ", int_67]))
join_5 = TextJoin(Text=[join_4, join_2, join, join_3])

# ---- group: residential list
tag_5 = TextTag3D(Location=pt_14, Text=join_5, Size=number_slider_4, Colour=ColourSwatch(SwatchColor=RGB(201, 201, 201)), Justification=1)

# ----
addition_2 = Addition(A=int_67, B=int_66)

# ---- group: total ppl #
int_68 = Integer(addition_2)

# Energy per Capita Heatmap
int_69 = Integer(int_68)

# ----
int_70 = Integer(int_69)
congestion = PythonScript(A=crossings, S=srf, P=pt_6, N=int_70, B=bool_4)  # -> out, C, t; inputs A: list, P: list
# ---------- congestion: Python ----------
import random 
import rhinoscriptsyntax as rs

ratio = float((N-700)/(35000.0-700.0))

C=[]
t=[]

#print ratio

hue = 50 - 50 * ratio
alpha = 255 * ratio

if B :
    hue += 45
    alpha /= float(3)

min_distance = []

for p in P:
    mind = 10000000
    for a in A:
        d = rs.Distance(a,p)
        if d < mind:
            mind = d
    distance =  (1-mind/250) * 0.2 
    hue += distance*2
    if not B:
        t.append((60-hue)*1.5)
    else:
        t.append((100-hue)*0.5)
    C.append(rs.ColorHLSToRGB((hue+random.randint(-2,2),128,255,alpha+random.randint(-5,5))));
# ---------- end congestion ----------
gradient = Gradient(LowerLimit=0, UpperLimit=100, Parameter=congestion.t, stops=[0: RGB(79, 79, 79), 0.793: RGB(173, 0, 0)])
pshift_22 = ShiftPaths(Data=gradient, Offset=-1)
graft_3 = GraftTree(Tree=pshift_22, IncludeEmptyLists=True, IncludeNullItems=True)
mspray_2 = MeshSpray(Mesh=graft, Points=Point(0, 0, 0), Colours=graft_3, SprayMode=0)
mspray_3 = MeshSpray(Mesh=graft_2, Points=Point(0, 0, 0), Colours=graft_3, SprayMode=0)
mjoin_5 = MeshJoin(Meshes=flatten(mspray_2))
mjoin_6 = MeshJoin(Meshes=flatten(mspray_3))

# ---- group: road traffic lego
mesh_36 = Mesh(mjoin_5)

# ---- group: road traffic 3D
mesh_37 = Mesh(mjoin_6)

# ----
panel_50 = Panel(congestion.t)
# Human Interaction
amenities = PythonScript(N=int_68)  # -> out, A
# ---------- amenities: Python ----------
import math

title = ["density","subway_station","department_store","embassy","beauty_salon","police","courthouse","cemetery","pharmacy","local_government_office","shopping_mall","city_hall","rv_park","shoe_store","bank","bowling_alley","school","bar","university","car_dealer","taxi_stand","grocery_or_supermarket","fire_station","church","convenience_store","campground","lawyer","parking","post_office","hindu_temple","hardware_store","meal_takeaway","movie_rental","gas_station","funeral_home","aquarium","restaurant","home_goods_store","atm","veterinary_care","airport","locksmith","bus_station","hospital","night_club","electrician","mosque","amusement_park","lodging","florist","liquor_store","museum","car_rental","stadium","store","hair_care","transit_station","meal_delivery","gym","park","dentist","library","book_store","painter","roofing_contractor","moving_company","clothing_store","furniture_store","physiotherapist","casino","art_gallery","car_wash","movie_theater","spa","accounting","cafe","car_repair","synagogue","real_estate_agency","electronics_store","doctor","bicycle_store","storage","zoo","train_station","jewelry_store","laundry","insurance_agency","plumber","pet_store","bakery","travel_agency"]

newyork = [27673,10,6,10,74,3,0,0,29,27,16,0,0,28,111,2,35,200,6,13,0,20,2,13,23,1,200,89,6,0,0,74,5,0,0,0,200,102,183,2,1,7,41,22,60,16,0,0,140,12,7,9,7,0,200,60,51,28,35,13,135,31,18,5,1,28,200,21,46,1,26,1,35,39,200,96,18,0,200,105,200,2,11,0,0,200,29,200,9,2,37,177]
atlanta = [700,0,0,0,15,0,0,0,3,2,1,0,0,2,4,0,4,31,1,0,0,2,1,5,3,0,200,10,0,0,1,4,0,1,0,0,46,13,7,1,0,0,11,8,7,0,0,0,5,0,1,1,0,0,59,15,11,2,7,0,25,0,0,2,1,1,8,7,2,0,3,1,0,11,8,9,3,0,22,3,58,0,0,0,0,0,6,22,2,2,2,4]

ratio = (N - atlanta[0]) / float(newyork[0] - atlanta[0])
print ratio

amenities = {}

for i in range(len(title))[1:]:
    amenity =  title[i]
    num =  math.floor(atlanta[i]+(newyork[i]-atlanta[i]) * ratio)
    
    if title[i].startswith('law'): continue
    if title[i].startswith('jew'): continue
    if title[i].startswith('accoun'): continue
    if title[i].startswith('store'): continue
    if title[i].startswith('travel'): continue
    if title[i].startswith('cloth'): continue
    if title[i].startswith('local_'): continue
    if title[i].startswith('electronic'): continue
    if title[i].startswith('dent'): continue
    if title[i].startswith('insu'): continue
    if title[i].startswith('physio'): continue
    if title[i].startswith('real'): continue
    if title[i].startswith('doc'): continue
    if title[i].startswith('storage'): continue
    if title[i].startswith('painter'): continue
    if title[i].startswith('moving'): continue
    if title[i].startswith('subway'): continue
    if title[i].startswith('meal'): continue
    if title[i].startswith('embassy'): continue
    if title[i].startswith('shoe'): continue
    
    if num > 2:
        amenities[title[i]] = num

result = []
cnt = 0

for amenity in sorted(amenities, key=lambda k: amenities[k], reverse=True):
    cnt += 1
    if cnt%4 <= 1 : continue
    result.append('{}: {}'.format(amenity,int(amenities[amenity])))
    

print result

A = result
# ---------- end amenities ----------
panel_51 = Panel(amenities.A)
join_6 = TextJoin(Text=panel_51)

# ---- group: amenity list
tag_6 = TextTag3D(
    Location=pt_13,
    Text=join_6,
    Size=Slider(11.8, range=0..100),
    Colour=ColourSwatch(SwatchColor=RGB(201, 201, 201)),
    Justification=1)

# ----
panel_52 = Panel(int_68)
join_7 = TextJoin(Text=flatten(["Office: ", int_66]))
join_8 = TextJoin(Text=flatten([" - Regular: ", int_65]))
join_9 = TextJoin(Text=flatten([" - Co-working: ", int_61]))
join_10 = TextJoin(Text=flatten([" - Headquarter: ", int_60]))
join_11 = TextJoin(Text=[join_7, join_9, join_8, join_10])

# ---- group: residential list
tag_7 = TextTag3D(Location=pt_22, Text=join_11, Size=number_slider_4, Colour=ColourSwatch(SwatchColor=RGB(201, 201, 201)), Justification=1)

# ---- group: y
int_71 = Integer(pshift_18)

int_72 = Integer(int_71)

int_73 = Integer(int_71)

int_74 = Integer(int_71)

# ---- group: rotation
int_75 = Integer(neg_4)

int_76 = Integer(int_75)

int_77 = Integer(int_75)

# ----
dispatch_5 = Dispatch(List=int_77, DispatchPattern=and_2)  # -> ListA, ListB
rotate_2 = Rotate(Geometry=pshift_20, Angle=degrees(dispatch_5.ListA), Plane=PlaneXY(0, 0, 0))  # -> Geometry, Transform

# ---- group: rotation
int_78 = Integer(int_75)

# ----
subtraction_4 = Subtraction(A=subtraction_3, B=pshift_17)

# ---- group: x
int_79 = Integer(subtraction_4)

int_80 = Integer(int_79)

int_81 = Integer(int_79)

# ---- group: road check matrix
python_2 = PythonScript(xe=int_21, ye=int_30, x=int_81, y=int_73, id=int_37)  # -> out, m; inputs x: list, y: list, id: list
# ---------- python_2: Python ----------
"""
CityMatrix

written by "Ryan" Yan Zhang <ryanz@mit.edu>
for MIT Media Lab, Changing Place Group
April.6th.2016
"""

import rhinoscriptsyntax as rs

m = [[-1 for n in range(xe)] for n in range(ye)]

#for n in range(len(id)):
#    if id[n] == 7:
#        m[y[n]][x[n]] = 6
#    else:
#        m[y[n]][x[n]] = id[n]

for n in range(len(id)):
    m[y[n]][x[n]] = id[n]

for n in range(ye):
    print m[n]
# ---------- end python_2 ----------

# ----
modulecenter = ModuleCenter(pt=pt_4, num=num_4, int_2=int_81, int=int_73)  # -> pt_5, transform_2

# ---- group: road check list
python_3 = PythonScript(xe=int_21, ye=int_30, x=int_81, y=int_73, id=int_37, m=python_2.m)  # -> out, rdType; inputs x: list, y: list, id: list, m: list
# ---------- python_3: Python ----------
"""
CityMatrix

written by "Ryan" Yan Zhang <ryanz@mit.edu>
for MIT Media Lab, Changing Place Group
April.6th.2016
"""

import rhinoscriptsyntax as rs

rdType = []

for n in range(len(id)):
    
    code = []
    
    if id[n]==6:
        
        # 0: check x, y+1
        if y[n]+1>ye-1:
            code.append(1)
        else:
            if m[y[n]+1][x[n]]==6:
                code.append(1)
            else:
                code.append(0)
        
        # 1: check x+1, y
        if x[n]+1>xe-1:
            code.append(1)
        else:
            if m[y[n]][x[n]+1]==6:
                code.append(1)
            else:
                code.append(0)
        
        # 2: check x, y-1
        if y[n]-1<0:
            code.append(1)
        else:
            if m[y[n]-1][x[n]]==6:
                code.append(1)
            else:
                code.append(0)
        
        # 3: check x-1, y
        if x[n]-1<0:
            code.append(1)
        else:
            if m[y[n]][x[n]-1]==6:
                code.append(1)
            else:
                code.append(0)
    
    else:
        
        code = [0,0,0,0]
    
    print code
    rdType.append(code)
# ---------- end python_3 ----------

# ----
xform = Transform(modulecenter.transform_2)  # disabled

# ---- group: module center
pt_24 = Point(modulecenter.pt_5)

# ----
dispatch_6 = Dispatch(List=pt_24, DispatchPattern=equals_2.Equality)  # -> ListA, ListB
dispatch_7 = Dispatch(List=pt_24, DispatchPattern=equals.Equality)  # -> ListA, ListB; disabled
vec2pt_3 = Vector2Pt(PointA=Point(0, 0, 0), PointB=dispatch_6.ListA, Unitize=False)  # -> Vector, Length
vec2pt_4 = Vector2Pt(PointA=Point(0, 0, 0), PointB=dispatch_7.ListA, Unitize=False)  # -> Vector, Length; disabled
move_7 = Move(Geometry=mesh_9, Motion=vec2pt_3.Vector)  # -> Geometry, Transform
move_8 = Move(Geometry=mesh_10, Motion=vec2pt_4.Vector)  # -> Geometry, Transform; disabled

# ---- group: special JR
mesh_38 = Mesh(move_7.Geometry)

# ---- group: special Xin
mesh_39 = Mesh(move_8.Geometry)  # disabled

# ---- group: module center
pt_25 = Point(pt_24)

# ----
dispatch_8 = Dispatch(List=pt_25, DispatchPattern=bool_17)  # -> ListA, ListB

# ---- group: road check list
python_4 = PythonScript(pt=pt_24, id=int_37, rdType=python_3.rdType, rdQua0=mesh_32, c0=pt_16, rdQua1=mesh_31, c1=pt_15)  # -> out, allRoadMesh; inputs pt: list, id: list, rdType: list, rdQua0: list, rdQua1: list
# ---------- python_4: Python ----------
"""
CityMatrix

written by "Ryan" Yan Zhang <ryanz@mit.edu>
for MIT Media Lab, Changing Place Group
April.6th.2016
"""

import rhinoscriptsyntax as rs
import Rhino.Geometry as rg

allRoadMesh = []

for n in range(len(id)):
    
    if id[n]==6:
        
        for i in range(len(rdType[n])):
            t = rdType[n][i]
            v = rs.PointCoordinates(pt[n])
            if t == 0:
                c = rs.PointCoordinates(c0)
                vx = v[0]-c[0]
                vy = v[1]-c[1]
                new = rs.CopyObject(rdQua0[i],(vx,vy,0.))
            else:
                c = rs.PointCoordinates(c1)
                vx = v[0]-c[0]
                vy = v[1]-c[1]
                new = rs.CopyObject(rdQua1[i],(vx,vy,0.))
            allRoadMesh.append(new)
# ---------- end python_4 ----------

# ---- group: road mesh final!
mesh_40 = Mesh(python_4.allRoadMesh)

# ---- group: building center
pt_26 = Point(dispatch_8.ListA)

# ----
move_9 = Move(Geometry=mesh_40, Motion=vec_2)  # -> Geometry, Transform
box = DomainBox(Base=pt_26, X=dom_2, Y=dom_2, Z=dom_4)
dispatch_9 = Dispatch(List=pt_24, DispatchPattern=smaller_4.SmallerThan)  # -> ListA, ListB
vec2pt_5 = Vector2Pt(PointA=Point(0, 0, 0), PointB=dispatch_9.ListA, Unitize=False)  # -> Vector, Length
move_10 = Move(Geometry=box, Motion=vec_2)  # -> Geometry, Transform
dispatch_10 = Dispatch(List=pt_24, DispatchPattern=and_2)  # -> ListA, ListB
move_11 = Move(Geometry=mesh_22, Motion=vec2pt_5.Vector)  # -> Geometry, Transform

# ---- group: building geo
box_2 = Box(move_10.Geometry)

# ---- group: textured buildings
panel_53 = Panel("C:\Users\RYAN\Documents\GitHub\CityMatrix\Map\PEV_PSG AND PKG_300DPI.png")  # disabled
panel_54 = Panel("0.01")  # disabled
swatch_5 = ColourSwatch(SwatchColor=RGB(255, 255, 255))  # disabled
boxmap = BoxMapping(Mesh=box_2, Box=box_2)  # disabled
previewmat_2 = CustomPreviewMaterials(Geometry=boxmap, DiffuseColor=swatch_5, Transparency=panel_54, DiffuseBitmap=panel_53)  # disabled

# ----
vec2pt_6 = Vector2Pt(PointA=Point(0, 0, 0), PointB=dispatch_10.ListA, Unitize=False)  # -> Vector, Length
move_12 = Move(Geometry=rotate_2.Geometry, Motion=vec2pt_6.Vector)  # -> Geometry, Transform
dispatch_11 = Dispatch(List=pt_24, DispatchPattern=or)  # -> ListA, ListB

# ---- group: building lego modules
mesh_41 = Mesh(move_12.Geometry)

# ---- group: road mesh final!
mesh_42 = Mesh(python_4.allRoadMesh)

# ---- group: blank
mesh_43 = Mesh(move_11.Geometry)

mesh_44 = Mesh(mesh_43)

# ----
move_13 = Move(Geometry=mesh_44, Motion=vec_2)  # -> Geometry, Transform

# ---- group: blank
mesh_45 = Mesh(move_13.Geometry)

# ---- group: road
mesh_46 = Mesh(move_9.Geometry)

# ---- group: road center pts
pt_27 = Point(dispatch_11.ListA)

# ---- group: x
int_82 = Integer(int_79)

# ---- group: blank modules
mesh_47 = Mesh(mesh_43)

# ----
geobottomcenter = GeoBottomCenter_2(geo=mesh_47)
lng = ListLength(List=geobottomcenter)
division_7 = Division(A=int, B=lng)
randomsplit = RandomSplitList(MasterList=geobottomcenter, Seed=Slider(32, range=0..100), Split=division_7)  # -> ListA, ListB
lng_2 = ListLength(List=randomsplit.ListA)
division_8 = Division(A=int_2, B=lng_2)
randomsplit_2 = RandomSplitList(MasterList=randomsplit.ListA, Seed=Slider(25, range=0..100), Split=division_8)  # -> ListA, ListB

# ---- group: parking center
pt_28 = Point(randomsplit.ListB)

# ---- group: park center lego
pt_29 = Point(randomsplit_2.ListB)

# ----
move_14 = Move(Geometry=pt_29, Motion=vec_3)  # -> Geometry, Transform

# ---- group: park center 3D
pt_30 = Point(move_14.Geometry)

# ----
planesrf_2 = PlaneSurface(Plane=pt_30, XSize=dom_3, YSize=dom_3)
lng_3 = ListLength(List=pt_30)
random = Random(Range="0.8 to 1.4", Number=lng_3, Seed=Slider(72, range=0..100))
multiplication_27 = Multiplication(A=random, B=tree_scale)
scale_4 = Scale(Geometry=mesh_30, Center=Point(0, 0, 0), Factor=multiplication_27)  # -> Geometry, Transform
random_2 = Random(Range=dom, Number=lng_3, Seed=Slider(17, range=0..100))
random_3 = Random(Range=Domain(0, 1000), Number=lng_3, Seed=Slider(35, range=0..100))
vec2pt_7 = Vector2Pt(PointA=Point(0, 0, 0), PointB=pt_29, Unitize=False)  # -> Vector, Length
vec2pt_8 = Vector2Pt(PointA=Point(0, 0, 0), PointB=pt_28, Unitize=False)  # -> Vector, Length
popgeo = PopulateGeometry(Geometry=flatten(planesrf_2), Count=flatten(random_2), Seed=flatten(random_3))
move_15 = Move(Geometry=mesh_29, Motion=vec2pt_7.Vector)  # -> Geometry, Transform
move_16 = Move(Geometry=mesh_28, Motion=vec2pt_8.Vector)  # -> Geometry, Transform

# ---- group: tree center
pt_31 = Point(flatten(popgeo))

# ----
vec2pt_9 = Vector2Pt(PointA=Point(0, 0, 0), PointB=pt_31, Unitize=False)  # -> Vector, Length
move_17 = Move(Geometry=scale_4.Geometry, Motion=vec2pt_9.Vector)  # -> Geometry, Transform

# ---- group: parking lego
mesh_48 = Mesh(move_15.Geometry)

# ----
move_18 = Move(Geometry=mesh_48, Motion=vec_3)  # -> Geometry, Transform

# ---- group: parking 3D
mesh_49 = Mesh(move_18.Geometry)

# ---- group: parking lego
mesh_50 = Mesh(move_16.Geometry)

# ----
move_19 = Move(Geometry=mesh_50, Motion=vec_3)  # -> Geometry, Transform

# ---- group: parking 3D
mesh_51 = Mesh(move_19.Geometry)

# ---- group: trees 3D
mesh_52 = Mesh(move_17.Geometry)

# ----
pt_32 = ConstructPoint(XCoordinate=Slider(3.5, range=0..10), YCoordinate=Slider(-14, range=-30..0), ZCoordinate=Slider(5.1, range=0..10))
panel_55 = Panel(int_79)
panel_56 = Panel(int_71)
panel_57 = Panel(int_75)
panel_58 = Panel(int_35)
move_20 = Move(Geometry=rotate.Geometry, Motion=vec2pt_2.Vector)  # -> Geometry, Transform

# ---- group: total cell #
int_83 = Integer(multiplication_14)

# ---- group: floor #s
pshift_23 = ShiftPaths(Data=move_12.Transform, Offset=-1)
pt_33 = ConstructPoint(XCoordinate=Slider(3.5, range=0..10), YCoordinate=Slider(-14, range=-30..0), ZCoordinate=Slider(5.1, range=0..10))
graft_4 = GraftTree(Tree=rotate_2.Transform, IncludeEmptyLists=True, IncludeNullItems=True)
graft_5 = GraftTree(Tree=pshift_23, IncludeEmptyLists=True, IncludeNullItems=True)
dispatch_12 = Dispatch(List=int_37, DispatchPattern=and_2)  # -> ListA, ListB
xy_3 = XYPlane(Origin=pt_33)
comp = Compound(Transforms=[graft_4, graft_5])
item_47 = ListItem(List=txt_18, Index=graft(dispatch_12.ListA), Wrap=True)
transform = Transform(Geometry=xy_3, Transform=comp)
pshift_24 = ShiftPaths(Data=item_47, Offset=-1)
pshift_25 = ShiftPaths(Data=transform, Offset=-1)
txt_19 = Text(pshift_24)
tag_8 = TextTag3D(
    Location=pshift_25,
    Text=txt_19,
    Size=Slider(17, range=0..100),
    Colour=ColourSwatch(SwatchColor=RGB(0, 0, 0)),
    Justification=5)

# ----
xy_4 = XYPlane(Origin=pt_32)
comp_2 = Compound(Transforms=flatten([rotate.Transform, move_20.Transform]))
panel_59 = Panel(int_83)

# ---- group: dock lego modules
mesh_53 = Mesh(move_20.Geometry)

# ----
transform_2 = Transform(Geometry=xy_4, Transform=comp_2)

# ---- group: dock lego floor number
tag_9 = TextTag3D(
    Location=transform_2,
    Text=item_37,
    Size=Slider(17, range=0..100),
    Colour=ColourSwatch(SwatchColor=RGB(0, 0, 0)),
    Justification=5)

# ---- group: sticky rotations
python_5 = PythonScript(x=int_75)  # -> out, rotations; inputs x: list; disabled
# ---------- python_5: Python ----------
"""
Realtime Simulator

written by Yan "Ryan" Zhang <ryanz@mit.edu>
for MIT Media Lab, Changing Place Group, CityScope Project
March.7th.2016
"""

import scriptcontext as sc

sc.sticky["rotations"] = x

rotations = sc.sticky["rotations"]
# ---------- end python_5 ----------

# ---- group: sticky y steps
python_6 = PythonScript(x=int_71)  # -> out, ySteps; inputs x: list; disabled
# ---------- python_6: Python ----------
"""
Realtime Simulator

written by Yan "Ryan" Zhang <ryanz@mit.edu>
for MIT Media Lab, Changing Place Group, CityScope Project
March.7th.2016
"""

import scriptcontext as sc

sc.sticky["ySteps"] = x

ySteps = sc.sticky["ySteps"]
# ---------- end python_6 ----------

# ---- group: sticky moduleIDs
python_7 = PythonScript(x=int_35)  # -> out, moduleIDs; inputs x: list; disabled
# ---------- python_7: Python ----------
"""
Realtime Simulator

written by Yan "Ryan" Zhang <ryanz@mit.edu>
for MIT Media Lab, Changing Place Group, CityScope Project
March.7th.2016
"""

import scriptcontext as sc

sc.sticky["moduleIDs"] = x

moduleIDs = sc.sticky["moduleIDs"]
# ---------- end python_7 ----------

# ---- group: sticky x steps
python_8 = PythonScript(x=int_79)  # -> out, xSteps; inputs x: list; disabled
# ---------- python_8: Python ----------
"""
Realtime Simulator

written by Yan "Ryan" Zhang <ryanz@mit.edu>
for MIT Media Lab, Changing Place Group, CityScope Project
March.7th.2016
"""

import scriptcontext as sc

sc.sticky["xSteps"] = x

xSteps = sc.sticky["xSteps"]
# ---------- end python_8 ----------

# ----
panel_60 = Panel(python_5.rotations)  # disabled
panel_61 = Panel(python_5.out)  # disabled
panel_62 = Panel(python_6.ySteps)  # disabled
panel_63 = Panel(python_6.out)  # disabled
panel_64 = Panel(python_8.xSteps)  # disabled
panel_65 = Panel(python_8.out)  # disabled
panel_66 = Panel(python_7.moduleIDs)  # disabled
panel_67 = Panel(python_7.out)  # disabled

# ---- group: module center
pt_34 = Point(modulecenter.pt_5)

# ----
srf_2 = Surface(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)

# ---- group: module id
int_84 = Integer(int_35)

# ---- group: dockID
int_85 = Integer(item_28)

# ----
equals_11 = Equality(FirstNumber=int_40, SecondNumber=int_85)  # -> Equality, Inequality
multiplication_28 = Multiplication(A=equals_11.Inequality, B=6)
addition_3 = Addition(A=int_40, B=multiplication_28)
mesh_54 = Mesh(srf_2)
equals_12 = Equality(FirstNumber=int_85, SecondNumber="-1")  # -> Equality, Inequality
filter_8 = StreamFilter(Gate=equals_12.Equality, Stream0=addition_3, Stream1=int_40)
item_48 = ListItem(List=col_2, Index=graft(filter_8), Wrap=False)
pshift_26 = ShiftPaths(Data=item_48, Offset=-1)

# ---- group: color for each building
col_3 = Colour(pshift_26)

# ---- group: 3D Buldings
preview_2 = CustomPreview(Geometry=box_2, Shader=col_3)

# ----
equals_13 = Equality(FirstNumber=int_84, SecondNumber=int_85)  # -> Equality, Inequality
Z_4 = UnitZ(Factor=Slider(5.3, range=0..10))
move_21 = Move(Geometry=mesh_54, Motion=Z_4)  # -> Geometry, Transform
dispatch_13 = Dispatch(List=pt_34, DispatchPattern=equals_13.Inequality)  # -> ListA, ListB
vec2pt_10 = Vector2Pt(PointA=Point(0, 0, 0), PointB=dispatch_13.ListA, Unitize=False)  # -> Vector, Length
move_22 = Move(Geometry=move_21.Geometry, Motion=vec2pt_10.Vector)  # -> Geometry, Transform
mjoin_7 = MeshJoin(Meshes=move_22.Geometry)
filter_9 = StreamFilter(Gate=equals_12.Equality, Stream0=mjoin_7)
preview_3 = CustomPreview(Geometry=filter_9, Shader=ColourSwatch(SwatchColor=RGBA(0, 0, 0, 128)))

# ==== cluster ModuleCenter
pt = ClusterInput()
int = ClusterInput()
num = ClusterInput()
int_2 = ClusterInput()

# ---- group: y
int_3 = Integer(int)

# ---- group: cell size
num_2 = Number(num)

# ---- group: x
int_4 = Integer(int_2)

# ---- group: center
pt_2 = Point(pt)

# ----
pt_3 = ConstructPoint(XCoordinate=0, YCoordinate=0, ZCoordinate=0)  # disabled
addition = Addition(A=int_4, B=0.5)
vec2pt = Vector2Pt(PointA=pt_3, PointB=pt_2, Unitize=False)  # -> Vector, Length; disabled
addition_2 = Addition(A=int_3, B=0.5)
multiplication = Multiplication(A=addition, B=num_2)
lng = ListLength(List=int_4)  # disabled
move = Move(Motion=vec2pt.Vector)  # -> Geometry, Transform; disabled
multiplication_2 = Multiplication(A=addition_2, B=num_2)
X = UnitX(Factor=multiplication)
repeat = RepeatData(Data=move.Transform, Length=lng)  # disabled
neg = Negative(Value=multiplication_2)
move_2 = Move(Geometry=pt_2, Motion=X)  # -> Geometry, Transform
graft = GraftTree(Tree=move_2.Transform, IncludeEmptyLists=True, IncludeNullItems=True)  # disabled
Y = UnitY(Factor=neg)
pshift = ShiftPaths(Data=repeat, Offset=-1)  # disabled
move_3 = Move(Geometry=move_2.Geometry, Motion=Y)  # -> Geometry, Transform
graft_2 = GraftTree(Tree=move_3.Transform, IncludeEmptyLists=True, IncludeNullItems=True)  # disabled
comp = Compound(Transforms=[graft, graft_2])  # disabled
graft_3 = GraftTree(Tree=pshift, IncludeEmptyLists=True, IncludeNullItems=True)  # disabled
comp_2 = Compound(Transforms=[comp, graft_3])  # disabled

# ---- group: module center
pt_4 = Point(move_3.Geometry)

# ----
pshift_2 = ShiftPaths(Data=comp_2, Offset=-1)  # disabled
transform = Transform(pshift_2)  # disabled
pt_5 = ClusterOutput(pt_4)
transform_2 = ClusterOutput(transform)  # disabled

# ==== cluster MoveToOrgin
num = ClusterInput()
G = ClusterInput()
num_2 = Number(num)
geobottomcenter = GeoBottomCenter(geo=G)
vec2pt = Vector2Pt(PointA=geobottomcenter, PointB=Point(0, 0, 0), Unitize=False)  # -> Vector, Length
move = Move(Geometry=G, Motion=vec2pt.Vector)  # -> Geometry, Transform
scale_nu = ScaleNU(Geometry=move.Geometry, Plane=PlaneXY(0, 0, 0), ScaleX=num_2, ScaleY=num_2, ScaleZ=1)  # -> Geometry, Transform
G_2 = ClusterOutput(scale_nu.Geometry)

# ==== cluster GeoBottomCenter_2
geo = ClusterInput()
geo_2 = Geometry(geo)
bbox = BoundingBox(Content=geo_2, Plane=PlaneXY(0, 0, 0))  # -> Box, Box_2
box_corners = BoxCorners(Box=bbox.Box)  # -> CornerA, CornerB, CornerC, CornerD, CornerE, CornerF, CornerG, CornerH
pdecon = Deconstruct(Point=box_corners.CornerA)  # -> XComponent, YComponent, ZComponent
pdecon_2 = Deconstruct(Point=box_corners.CornerC)  # -> XComponent, YComponent, ZComponent
addition = Addition(A=pdecon.XComponent, B=pdecon_2.XComponent)
addition_2 = Addition(A=pdecon.YComponent, B=pdecon_2.YComponent)
division = Division(A=addition, B=2)
division_2 = Division(A=addition_2, B=2)
pt = ConstructPoint(XCoordinate=division, YCoordinate=division_2, ZCoordinate=pdecon.ZComponent)
pshift = ShiftPaths(Data=pt, Offset=-1)
pt_2 = Point(pshift)
pt_3 = ClusterOutput(pt_2)

# ==== cluster GetPlaneFrom2pts
pt = ClusterInput()
pt_2 = ClusterInput()

# ---- group: current cam tgt pos
pt_3 = Point(pt)

# ---- group: current cam pos
pt_4 = Point(pt_2)

# ----
Z = UnitZ(Factor=100)
move = Move(Geometry=pt_3, Motion=Z)  # -> Geometry, Transform
pl_3pt = Plane3Pt(PointA=pt_3, PointB=pt_4, PointC=move.Geometry)
pt_5 = PointOriented(BasePlane=pl_3pt, UComponent=0, VComponent=0, WComponent=-100)
pt_6 = PointOriented(BasePlane=pl_3pt, UComponent=0, VComponent=100, WComponent=0)
pl_3pt_2 = Plane3Pt(PointA=pt_3, PointB=pt_5, PointC=pt_6)
pln = Plane(pl_3pt_2)
pln_2 = ClusterOutput(pln)

# ==== cluster GeoBottomCenter
geo = ClusterInput()
geo_2 = Geometry(geo)
bbox = BoundingBox(Content=geo_2, Plane=PlaneXY(0, 0, 0))  # -> Box, Box_2
box_corners = BoxCorners(Box=bbox.Box)  # -> CornerA, CornerB, CornerC, CornerD, CornerE, CornerF, CornerG, CornerH
pdecon = Deconstruct(Point=box_corners.CornerA)  # -> XComponent, YComponent, ZComponent
pdecon_2 = Deconstruct(Point=box_corners.CornerC)  # -> XComponent, YComponent, ZComponent
addition = Addition(A=pdecon.XComponent, B=pdecon_2.XComponent)
addition_2 = Addition(A=pdecon.YComponent, B=pdecon_2.YComponent)
division = Division(A=addition, B=2)
division_2 = Division(A=addition_2, B=2)
pt = ConstructPoint(XCoordinate=division, YCoordinate=division_2, ZCoordinate=pdecon.ZComponent)
pt_2 = Point(pt)
pt_3 = ClusterOutput(pt_2)
