# Grasshopper definition 160427_CityMatrix.gh (Grasshopper 0.9.76)
# plug-ins: Python Interpreter, gHowl, HDTReference, LunchBox

# 3D City Grid System
res_gray = ColourSwatch(SwatchColor=RGB(255, 255, 255))

# ---- group: mesh coloring
com_color = ColourSwatch(SwatchColor=RGB(255, 122, 122))
com_gray = ColourSwatch(SwatchColor=RGB(171, 171, 171))
res_color = ColourSwatch(SwatchColor=RGB(251, 255, 122))
mesh = Mesh([<mesh referenced from the Rhino model> x3])
sidewalk = ColourSwatch(SwatchColor=RGB(107, 107, 107))
bikelane = ColourSwatch(SwatchColor=RGB(86, 135, 87))
res_gray_2 = ColourSwatch(SwatchColor=RGB(227, 227, 227))
parking = ColourSwatch(SwatchColor=RGB(196, 156, 100))
blank = ColourSwatch(SwatchColor=RGB(110, 110, 110))
road = ColourSwatch(SwatchColor=RGB(64, 64, 64))
park = ColourSwatch(SwatchColor=RGB(165, 201, 44))
text = ColourSwatch(SwatchColor=RGB(0, 0, 0))
mcol = MeshColours(Mesh=mesh, Colours=road)
mesh_2 = Mesh(mcol)

# ---- group: shrink
cell_shrink = Slider(0.98, range=0.75..1)

# ---- group: module meshes lego ref: -1
mesh_3 = Mesh(<mesh referenced from the Rhino model>)

# ---- group: module meshes lego ref: 0 to 5
mesh_4 = Mesh([<mesh referenced from the Rhino model> x6])

# ---- group: colortizer orgin
# CityMatrix
# 
# by Yan "Ryan" Zhang <ryanz@mit.edu>
# for MIT Media Lab, Changing Place Group, CityScope Project
# March.17th.2016
# LEGO Grid System
pt = Point(<point referenced from the Rhino model>)

# ---- group: module meshes lego ref: 6 line bike
mesh_5 = Mesh(<mesh referenced from the Rhino model>)  # disabled

# ---- group: table size ref pt
pt_2 = Point(<point referenced from the Rhino model>)

# ---- group: module meshes lego ref: 6 line car
mesh_6 = Mesh(<mesh referenced from the Rhino model>)  # disabled

# ----
panel = Panel("7002")  # disabled
# PEVs
panel_2 = Panel("127.0.0.1")  # disabled

# ---- group: all road pieces
pt_3 = Point([Point(906.25, 156.25, 0), Point(906.25, 531.25, 0), Point(906.25, 781.25, 0), Point(906.25, 656.25, 0), Point(906.25, 281.25, 0), Point(156.25, 906.25, 0)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])

pt_4 = Point([Point(906.25, 156.25, 0), Point(906.25, 531.25, 0), Point(906.25, 781.25, 0), Point(906.25, 656.25, 0), Point(906.25, 281.25, 0), Point(156.25, 906.25, 0)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])  # disabled

# ----
# Block Floor Numbers @ Lego
number_slider = Slider(3.5, range=0..10)  # disabled
number_slider_2 = Slider(-14, range=-30..0)  # disabled
number_slider_3 = Slider(5.1, range=0..10)  # disabled

# ---- group: intersections
crossings = Point([Point(156.25, 281.25, 0), Point(468.75, 281.25, 0), Point(718.75, 281.25, 0), Point(156.25, 656.25, 0), Point(468.75, 656.25, 0), Point(718.75, 656.25, 0), Point(906.25, 906.25, 0), Point(718.75, 906.25, 0), Point(468.75, 906.25, 0), Point(156.25, 906.25, 0), Point(906.25, 281.25, 0), Point(906.25, 656.25, 0), Point(906.25, 781.25, 0), Point(906.25, 531.25, 0), Point(906.25, 156.25, 0)])

crossings_2 = Point([Point(156.25, 281.25, 0), Point(468.75, 281.25, 0), Point(718.75, 281.25, 0), Point(156.25, 656.25, 0), Point(468.75, 656.25, 0), Point(718.75, 656.25, 0), Point(906.25, 906.25, 0), Point(718.75, 906.25, 0), Point(468.75, 906.25, 0), Point(156.25, 906.25, 0), Point(906.25, 281.25, 0), Point(906.25, 656.25, 0), Point(906.25, 781.25, 0), Point(906.25, 531.25, 0), Point(906.25, 156.25, 0)])  # disabled

# ----
# mid
number_slider_4 = Slider(55, range=0..100)
# mid
number_slider_5 = Slider(23, range=0..100)
_4_commed = Slider(6, range=1..25)
_1_resmed = Slider(4, range=1..25)
_3_comhq = Slider(3, range=1..25)
_0_reslux = Slider(1, range=1..25)
_2_resmu = Slider(20, range=1..25)
_5_rescw = Slider(20, range=1..25)

# ---- group: 3D building site move amount
X = UnitX(Factor="10000")

# ----
swatch = ColourSwatch(SwatchColor=RGB(255, 255, 255))  # disabled
panel_3 = Panel("C:\Users\RYAN\Documents\GitHub\CityMatrix\Map\PEV_PSG AND PKG_300DPI.png")  # disabled
panel_4 = Panel("0.01")  # disabled
xy = XYPlane(Origin=pt)
# young
number_slider_6 = Slider(200, range=0..500)
dist = Distance(PointA=pt, PointB=pt_2)
mesh_7 = Mesh(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)  # disabled
timer = Timer(TimerInterval=500, Target=division_2)  # disabled

# ---- group: 6 intersect bike
mesh_8 = Mesh(<mesh referenced from the Rhino model>)  # disabled

# ---- group: 6 intersect car
mesh_9 = Mesh(<mesh referenced from the Rhino model>)  # disabled

# ---- group: udp receiver
udp = UDPReceiver(Address=panel_2, Port=panel, Pattern=0)  # -> Info, Data; disabled

# ---- group: ppl per flr
# id5
# id3
# id4
# id0
# id2
# id1
# young
# mid
# old
panel_5 = Panel("0.2")
num = Number([panel_5, "2", "12", "1", "4", "15"])
num_2 = Number(["2", "5", "6", "6", "6", "9"])
num_3 = Number(["6", "3", "1", "9", "4", "0.5"])

# ---- group: ref mesh
mesh_10 = Mesh(<mesh referenced from the Rhino model>)

# ----
com = ColourSwatch(SwatchColor=RGB(158, 158, 158))
com_2 = ColourSwatch(SwatchColor=RGB(71, 71, 71))

# ---- group: ref mesh
# Traffic Heatmap - Yasushi
mesh_11 = Mesh(<mesh referenced from the Rhino model>)  # disabled

# ----
res = ColourSwatch(SwatchColor=RGB(212, 212, 212))
res_2 = ColourSwatch(SwatchColor=RGB(76, 76, 76))
movetoorgin = MoveToOrgin(G=mesh_3, num=cell_shrink)
movetoorgin_2 = MoveToOrgin(G=mesh_4, num=cell_shrink)

# ---- group: base cplane
pln = Plane(xy)

# ----
pt_5 = ConstructPoint(XCoordinate=number_slider, YCoordinate=number_slider_2, ZCoordinate=number_slider_3)  # disabled
pt_6 = ConstructPoint(XCoordinate=Slider(0, range=0..10), YCoordinate=Slider(0, range=-30..0), ZCoordinate=Slider(5.1, range=0..10))
split = TextSplit(Text=udp.Data)  # disabled

# ---- group: PEV center pt
pt_7 = Point(split)  # disabled

# ----
vec2pt = Vector2Pt(PointA=Point(0, 0, 0), PointB=pt_7, Unitize=False)  # -> Vector, Length; disabled
move = Move(Geometry=mesh_7, Motion=vec2pt.Vector)  # -> Geometry, Transform; disabled
vec = Vector(X)

# ---- group: private car / road quator 0s
mesh_12 = Mesh([<mesh referenced from the Rhino model> x4])
pt_8 = Point(<point referenced from the Rhino model>)

# ----
movetoorgin_3 = MoveToOrgin(G=mesh_10, num=cell_shrink)
mjoin = MeshJoin(Meshes=move.Geometry)  # disabled
movetoorgin_4 = MoveToOrgin(G=mesh_11, num=cell_shrink)  # disabled

# ---- group: private car / sidewalk quator 0s
mesh_13 = Mesh([<mesh referenced from the Rhino model> x4])
pt_9 = Point(<point referenced from the Rhino model>)

# ----
srf = Surface(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)
srf_2 = Surface(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)  # disabled
merge = Merge(Data1=res, Data2=res, Data3=res, Data4=com, Data5=com, Data6=com)
merge_2 = Merge(Data1=res_2, Data2=res_2, Data3=res_2, Data4=com_2, Data5=com_2, Data6=com_2)

# ---- group: range
B = DomainEnd(number_slider_6)

# ----
xy_2 = XYPlane(Origin=pt_5)  # disabled

# ---- group: range
B_2 = DomainEnd(Slider(120, range=0..500))

B_3 = DomainEnd(Slider(75, range=0..500))

# ---- group: PEVs
previewmat = CustomPreviewMaterials(Geometry=mjoin, DiffuseColor=swatch, Transparency=panel_4, DiffuseBitmap=panel_3)  # disabled

# ----
xy_3 = XYPlane(Origin=pt_6)

# ---- group: private car / road quator 1s
mesh_14 = Mesh([<mesh referenced from the Rhino model> x4])
pt_10 = Point(<point referenced from the Rhino model>)

# ---- group: private car
scale_nu = ScaleNU(Geometry=mesh_12, Plane=pt_8, ScaleX=cell_shrink, ScaleY=cell_shrink, ScaleZ=1)  # -> Geometry, Transform
scale_nu_2 = ScaleNU(Geometry=mesh_14, Plane=pt_10, ScaleX=cell_shrink, ScaleY=cell_shrink, ScaleZ=1)  # -> Geometry, Transform

# ---- group: private car / sidewalk quator 1s
mesh_15 = Mesh([<mesh referenced from the Rhino model> x4])
pt_11 = Point(<point referenced from the Rhino model>)

# ---- group: private car
scale_nu_3 = ScaleNU(Geometry=mesh_13, Plane=pt_9, ScaleX=cell_shrink, ScaleY=cell_shrink, ScaleZ=1)  # -> Geometry, Transform
scale_nu_4 = ScaleNU(Geometry=mesh_15, Plane=pt_11, ScaleX=cell_shrink, ScaleY=cell_shrink, ScaleZ=1)  # -> Geometry, Transform

# ----
merge_3 = Merge(Data1=merge, Data2=merge_2)

# ---- group: module meshes lego at orgin
mesh_16 = Mesh(movetoorgin_2)

mesh_17 = Mesh(movetoorgin)

# ----
pshift = ShiftPaths(Data=movetoorgin_3, Offset=-1)
pshift_2 = ShiftPaths(Data=movetoorgin_4, Offset=-1)  # disabled

# ---- group: PEV / road quator 0s
mesh_18 = Mesh([<mesh referenced from the Rhino model> x4])
pt_12 = Point(<point referenced from the Rhino model>)

# ----
number_slider_7 = Slider(17, range=0..100)  # disabled
dom = ConstructDomain(DomainStart=0, DomainEnd=B)

# ---- group: color for each type
col = Colour(merge_3)

# ----
dom_2 = ConstructDomain(DomainStart=0, DomainEnd=B_2)
dom_3 = ConstructDomain(DomainStart=0, DomainEnd=B_3)

# ---- group: PEV / sidewalk quator 0s
mesh_19 = Mesh([<mesh referenced from the Rhino model> x4])
pt_13 = Point(<point referenced from the Rhino model>)

# ---- group: floor height
panel_6 = Panel("3.5")

# ----
swatch_2 = ColourSwatch(SwatchColor=RGB(0, 0, 0))  # disabled

# ---- group: ref mesh at orgin
mesh_20 = Mesh(pshift)

# ----
move_2 = Move(Geometry=mesh_20, Motion=pt_3)  # -> Geometry, Transform

# ---- group: ref mesh at orgin
mesh_21 = Mesh(pshift_2)  # disabled

# ----
move_3 = Move(Geometry=mesh_21, Motion=pt_4)  # -> Geometry, Transform; disabled

# ---- group: PEV / road quator 1s
mesh_22 = Mesh([<mesh referenced from the Rhino model> x4])
pt_14 = Point(<point referenced from the Rhino model>)

# ---- group: PEV
scale_nu_5 = ScaleNU(Geometry=mesh_18, Plane=pt_12, ScaleX=cell_shrink, ScaleY=cell_shrink, ScaleZ=1)  # -> Geometry, Transform
scale_nu_6 = ScaleNU(Geometry=mesh_22, Plane=pt_14, ScaleX=cell_shrink, ScaleY=cell_shrink, ScaleZ=1)  # -> Geometry, Transform

# ---- group: base height
panel_7 = Panel("5.0")

# ---- group: PEV / sidewalk quator 1s
mesh_23 = Mesh([<mesh referenced from the Rhino model> x4])
pt_15 = Point(<point referenced from the Rhino model>)

# ---- group: PEV
scale_nu_7 = ScaleNU(Geometry=mesh_19, Plane=pt_13, ScaleX=cell_shrink, ScaleY=cell_shrink, ScaleZ=1)  # -> Geometry, Transform
scale_nu_8 = ScaleNU(Geometry=mesh_23, Plane=pt_15, ScaleX=cell_shrink, ScaleY=cell_shrink, ScaleZ=1)  # -> Geometry, Transform

# ----
number_slider_8 = Slider(4.9, range=0..10)  # disabled

# ---- group: multipe for ppls
number_slider_9 = Slider(3, range=0.1..10)

# ----
panel_8 = Panel("8")  # disabled
multiplication = Multiplication(A=num, B=number_slider_9)
multiplication_2 = Multiplication(A=num_2, B=number_slider_9)
multiplication_3 = Multiplication(A=num_3, B=number_slider_9)
Z = UnitZ(Factor=Slider(4.9, range=0..10))
Z_2 = UnitZ(Factor=number_slider_8)  # disabled

# ---- group: translate example
pt_16 = Point(Point(-15, -8, 0))  # disabled
python = PythonScript(point=pt_16)  # -> out, output; inputs point: Point3d; disabled
# ---------- python: Python ----------
import Rhino

transform = Rhino.Geometry.Transform.Translation(0,0,5)
point.Transform(transform)

output = point
# ---------- end python ----------

# ----
move_4 = Move(Geometry=move_2.Geometry, Motion=Z)  # -> Geometry, Transform
num_4 = Number(multiplication)
num_5 = Number(multiplication_2)
num_6 = Number(multiplication_3)
move_5 = Move(Geometry=move_3.Geometry, Motion=Z_2)  # -> Geometry, Transform; disabled
graft = GraftTree(Tree=move_4.Geometry, IncludeEmptyLists=True, IncludeNullItems=True)
graft_2 = GraftTree(Tree=move_5.Geometry, IncludeEmptyLists=True, IncludeNullItems=True)  # disabled
move_6 = Move(Geometry=move_4.Geometry, Motion=vec)  # -> Geometry, Transform
move_7 = Move(Geometry=move_5.Geometry, Motion=vec)  # -> Geometry, Transform; disabled

# ---- group: reduce ratio
number_slider_10 = Slider(0, range=0..1)

# ---- group: building height factor
number_slider_11 = Slider(2.5, range=0..10)

# ----
graft_3 = GraftTree(Tree=move_6.Geometry, IncludeEmptyLists=True, IncludeNullItems=True)
graft_4 = GraftTree(Tree=move_7.Geometry, IncludeEmptyLists=True, IncludeNullItems=True)  # disabled
number_slider_12 = Slider(0.2, range=0..1)
number_slider_13 = Slider(0.2, range=0..1)
number_slider_14 = Slider(0.2, range=0..1)
swatch_3 = ColourSwatch(SwatchColor=RGB(255, 208, 0))
swatch_4 = ColourSwatch(SwatchColor=RGB(0, 166, 255))
swatch_5 = ColourSwatch(SwatchColor=RGB(255, 0, 0))

# ---- group: dot shape
polygon = Polygon(Plane=PlaneXY(0, 0, 0), Radius=Slider(1, range=0..10), Segments=Slider(9, range=0..10), FilletRadius=0)  # -> Polygon, Length
boundary = BoundarySurfaces(Edges=polygon.Polygon)
mesh_24 = Mesh(boundary)

# ----
mesh_25 = Mesh(mesh_24)
mesh_26 = Mesh(mesh_24)
mesh_27 = Mesh(mesh_24)
number_slider_15 = Slider(10, range=10..100)
panel_9 = Panel("C:\Users\RYAN\Documents\GitHub\CityMatrix\Data\colortizer_data_rhino_02_YZ.txt")
panel_10 = Panel("C:\Users\RYAN\Documents\GitHub\CityMatrix\Data\colortizer_data_sample.txt")
# Parsing Colortizer Data (CityMatrix 16x16)
panel_11 = Panel("C:\Users\RYAN\Documents\GitHub\CityMatrix\Data\colortizer_data.txt")
panel_12 = Panel("C:\Users\RYAN\Documents\GitHub\CityMatrix\Data\colortizer_data_03_YZ.txt")

# ---- group: meshes lego ref: parking
mesh_28 = Mesh(<mesh referenced from the Rhino model>)

# ----
panel_13 = Panel("C:\Users\RYAN\Documents\GitHub\CityMatrix\Data\colortizer_data_rhino_01_YZ.txt")

# ---- group: meshes lego ref: park
mesh_29 = Mesh(<mesh referenced from the Rhino model>)

# ----
# Google Map @ Lego
planesrf = PlaneSurface(Plane=pln, XSize=Domain(0, 1000), YSize=Domain(-1000, 0))
Z_3 = UnitZ(Factor=20)
panel_14 = Panel("C:\Users\RYAN\Documents\GitHub\CityMatrix\Map\HAMBURG RS 1600pxl.jpg")
Z_4 = UnitZ(Factor=number_slider_15)
yz = YZPlane(Origin=Point(500, 0, 0))

# ---- group: road center - PEV
crv = Curve([<curve referenced from the Rhino model> x7])

# ---- group: road center - private car 1
crv_2 = Curve([<curve referenced from the Rhino model> x84])

# ---- group: road center - private car 2
crv_3 = Curve([<curve referenced from the Rhino model> x48])

# ----
move_8 = Move(Geometry=planesrf, Motion=Z_3)  # -> Geometry, Transform
msphereex = MeshSphereEx(Base=Z_4, Radius=number_slider_15, Count=Slider(5, range=0..10))
Z_5 = UnitZ(Factor=Slider(6, range=0..10))
movetoorgin_5 = MoveToOrgin(G=mesh_28, num=cell_shrink)

# ---- group: car shape mesh
# Cars PEVs @ Lego
number_slider_16 = Slider(11.1, range=0..30)
number_slider_17 = Slider(4.1, range=0..30)
number_slider_18 = Slider(1, range=0..2)
neg = Negative(Value=number_slider_16)
neg_2 = Negative(Value=number_slider_17)
dom_4 = ConstructDomain(DomainStart=neg, DomainEnd=number_slider_16)
dom_5 = ConstructDomain(DomainStart=neg_2, DomainEnd=number_slider_17)
rectangle = Rectangle(Plane=PlaneXY(0, 0, 0), XSize=dom_4, YSize=dom_5, Radius=number_slider_18)  # -> Rectangle, Length
planesrf_2 = PlaneSurface(Plane=PlaneXY(0, 0, 0), XSize=dom_4, YSize=dom_5)
offset = Offset(Curve=rectangle.Rectangle, Distance=number_slider_18, Plane=PlaneXY(0, 0, 0), Corners=1)
rdiff = RegionDifference(CurvesA=offset, CurvesB=rectangle.Rectangle)
boundary_2 = BoundarySurfaces(Edges=rdiff)
mesh_30 = Mesh(boundary_2)

# ----
mirror = Mirror(Geometry=crv_2, Plane=yz)  # -> Geometry, Transform
movetoorgin_6 = MoveToOrgin(G=mesh_29, num=cell_shrink)
Z_6 = UnitZ(Factor=6.5)
move_9 = Move(Geometry=msphereex, Motion=Z_5)  # -> Geometry, Transform

# ---- group: udp receiver
udp_2 = UDPReceiver(Address="127.0.0.1", Port="7001", Pattern=0)  # -> Info, Data

# ----
move_10 = Move(Geometry=mirror.Geometry, Motion=Z_6)  # -> Geometry, Transform
mcol_2 = MeshColours(Mesh=move_9.Geometry, Colours=park)
tree_scale = Slider(0.81, range=0.5..2)
split_2 = TextSplit(Text=udp_2.Data)
explode = Explode(Curve=move_10.Geometry, Recursive=True)  # -> Segments, Vertices

# ---- group: reading txt
file = ReadFile(File=panel_12, PerLineParse=True)

# ---- group: module meshes lego at orgin
mesh_31 = Mesh(movetoorgin_5)

mesh_32 = Mesh(movetoorgin_6)

# ----
shift = ShiftList(List=split_2, Shift=1, Wrap=False)
pshift_3 = ShiftPaths(Data=explode.Segments, Offset=-1)

# ---- group: meshes 3D ref: Tree
mesh_33 = Mesh(mcol_2)

# ---- group: overwrite toggle 1 - trans mode
transportation_mode = BooleanToggle(True)

# ----
txt = Text(file)
crv_4 = Curve(pshift_3)
txt_2 = Text(shift)

# ---- group: 3D building site move amount
vec_2 = Vector(X)

# ----
tree = Slider(2.13, range=0..5)
len = Length(Curve=crv_4)

# ---- group: colortizer data
txt_3 = Text(txt)

# ----
panel_15 = Panel(txt_3)
division = Division(A=len, B=Slider(28.7, range=0..30))

# ---- group: parking cell #
parking_cell = Slider(18, range=0..50)

# ---- group: total parking cell number
# Parking & Park
int = Integer(parking_cell)

# ----
divide = DivideCurve(Curve=crv_4, Count=division, Kinks=False)  # -> Points, Tangents, Parameters
split_3 = SplitList(List=txt_3, Index=9)  # -> ListA, ListB
multiplication_4 = Multiplication(A="3", B=tree)
multiplication_5 = Multiplication(A="3", B=tree)
dom_6 = ConstructDomain(DomainStart=multiplication_4, DomainEnd=multiplication_5)
pt_17 = Point(<point referenced from the Rhino model>)
equals = Equality(FirstNumber=divide.Parameters, SecondNumber=0)  # -> Equality, Inequality
pshift_4 = ShiftPaths(Data=split_3.ListB, Offset=-1)

# ---- group: park cell #
park_cell = Slider(33, range=0..50)

# ---- group: total park cell number
int_2 = Integer(park_cell)

# ----
pshift_5 = ShiftPaths(Data=split_3.ListA, Offset=-1)
show_google_map = BooleanToggle(False)
filter = StreamFilter(Gate=show_google_map, Stream1=move_8.Geometry)
previewmat_2 = CustomPreviewMaterials(Geometry=filter, DiffuseColor=ColourSwatch(SwatchColor=RGB(255, 255, 255)), Transparency="0.0", DiffuseBitmap=panel_14)
dispatch = Dispatch(List=divide.Tangents, DispatchPattern=equals.Equality)  # -> ListA, ListB
dispatch_2 = Dispatch(List=divide.Points, DispatchPattern=equals.Equality)  # -> ListA, ListB
item = ListItem(List=pshift_5, Index=4, Wrap=False)
item_2 = ListItem(List=pshift_5, Index=2, Wrap=False)
item_3 = ListItem(List=pshift_5, Index=3, Wrap=False)
item_4 = ListItem(List=txt_3, Index=265, Wrap=False)
item_5 = ListItem(List=pshift_5, Index=5, Wrap=False)
item_6 = ListItem(List=pshift_5, Index=6, Wrap=False)
item_7 = ListItem(List=pshift_5, Index=7, Wrap=False)
pshift_6 = ShiftPaths(Data=dispatch.ListB, Offset=-1)
pshift_7 = ShiftPaths(Data=dispatch_2.ListB, Offset=-1)
pdecon = Deconstruct(Point=pshift_7)  # -> XComponent, YComponent, ZComponent
inc = Includes(Value=pdecon.YComponent, Domain=Domain(0, 1000))  # -> Includes, Deviation
inc_2 = Includes(Value=pdecon.XComponent, Domain=Domain(0, 1000))  # -> Includes, Deviation
item_8 = ListItem(List=pshift_5, Index=1, Wrap=False)
item_9 = ListItem(List=pshift_5, Index=0, Wrap=False)
item_10 = ListItem(List=pshift_5, Index=8, Wrap=False)
and = GateAnd(A=inc_2.Includes, B=inc.Includes)
split_4 = TextSplit(Text=item, Separators="\t")
split_5 = TextSplit(Text=item_2, Separators="\t")
split_6 = TextSplit(Text=item_3, Separators="\t")
split_7 = TextSplit(Text=item_4, Separators="\t")
split_8 = TextSplit(Text=item_5, Separators="\t")
split_9 = TextSplit(Text=item_6, Separators="\t")
split_10 = TextSplit(Text=item_7, Separators="\t")
split_11 = TextSplit(Text=item_8, Separators="\t")
split_12 = TextSplit(Text=item_9, Separators="\t")
split_13 = TextSplit(Text=item_10, Separators="\t")
dispatch_3 = Dispatch(List=pshift_7, DispatchPattern=and)  # -> ListA, ListB
dispatch_4 = Dispatch(List=pshift_6, DispatchPattern=and)  # -> ListA, ListB
pshift_8 = ShiftPaths(Data=split_4, Offset=1)
pshift_9 = ShiftPaths(Data=split_5, Offset=1)
pshift_10 = ShiftPaths(Data=split_6, Offset=1)
pshift_11 = ShiftPaths(Data=split_7, Offset=1)
pshift_12 = ShiftPaths(Data=split_8, Offset=1)
pshift_13 = ShiftPaths(Data=split_9, Offset=1)
pshift_14 = ShiftPaths(Data=split_10, Offset=1)
pshift_15 = ShiftPaths(Data=split_11, Offset=1)
pshift_16 = ShiftPaths(Data=split_12, Offset=1)
pshift_17 = ShiftPaths(Data=split_13, Offset=1)
total_ppl = Slider(28269, range=700..30000)
number_slider_19 = Slider(19.1, range=0..100)
txt_4 = Text(pshift_11)
item_11 = ListItem(List=pshift_8, Index=0, Wrap=False)
item_12 = ListItem(List=pshift_9, Index=0, Wrap=False)
item_13 = ListItem(List=pshift_10, Index=0, Wrap=False)
item_14 = ListItem(List=pshift_12, Index=0, Wrap=False)
item_15 = ListItem(List=pshift_13, Index=0, Wrap=False)
item_16 = ListItem(List=pshift_14, Index=0, Wrap=False)
item_17 = ListItem(List=pshift_15, Index=0, Wrap=False)
item_18 = ListItem(List=pshift_16, Index=0, Wrap=False)
item_19 = ListItem(List=pshift_17, Index=0, Wrap=False)
vec_3 = Vector(dispatch_4.ListA)
pt_18 = Point(dispatch_3.ListA)
range = Range(Domain="1 to 30", Steps=100)
panel_16 = Panel(txt_4)
xy_4 = XYPlane(Origin=pt_18)
txt_5 = Text(item_11)
txt_6 = Text(item_12)
txt_7 = Text(item_13)
txt_8 = Text(item_14)
txt_9 = Text(item_15)
txt_10 = Text(item_16)
txt_11 = Text(item_17)
txt_12 = Text(item_18)
txt_13 = Text(item_19)
int_3 = Integer(range)
pt_19 = Point(<point referenced from the Rhino model>)
align = AlignPlane(Plane=xy_4, Direction=vec_3)  # -> Plane, Angle
panel_17 = Panel(txt_5)
panel_18 = Panel(txt_6)
panel_19 = Panel(txt_7)
panel_20 = Panel(txt_8)
panel_21 = Panel(txt_9)
panel_22 = Panel(txt_10)
panel_23 = Panel(txt_11)
panel_24 = Panel(txt_12)
panel_25 = Panel(txt_13)
txt_14 = Text(int_3)
txt_15 = Text(["Luxury", "Normal", "Micro-unit", "Head Quater", "Normal", "Co-working"])
txt_16 = Text(["Residential", "Residential", "Residential", "Office", "Office", "Office"])
txt_17 = Text(["Private Car", "Mobility on Demand"])
item_20 = ListItem(List=panel_16, Index=0, Wrap=False)
item_21 = ListItem(List=panel_16, Index=1, Wrap=False)
item_22 = ListItem(List=panel_16, Index=2, Wrap=False)
item_23 = ListItem(List=panel_16, Index=4, Wrap=False)
item_24 = ListItem(List=panel_16, Index=5, Wrap=False)
item_25 = ListItem(List=panel_16, Index=3, Wrap=False)
number_slider_20 = Slider(15.2, range=0..100)
int_4 = Integer(item_20)
int_5 = Integer(int_4)
int_6 = Integer(item_21)
int_7 = Integer(int_6)
int_8 = Integer(item_22)
int_9 = Integer(int_8)
item_26 = ListItem(List=pshift_8, Index=1, Wrap=False)

# ---- group: dockRotation
int_10 = Integer(item_26)

int_11 = Integer(item_26)

# ----
int_12 = Integer(item_25)
int_13 = Integer(int_12)
int_14 = Integer(item_23)
int_15 = Integer(int_14)
int_16 = Integer(item_24)
int_17 = Integer(int_16)
merge_4 = Merge(Data1=int_5, Data2=int_7, Data3=int_9, Data4=int_13, Data5=int_15, Data6=int_17)

# ---- group: all fl #s
txt_18 = Text([int_5, int_7, int_9, int_13, int_15, int_17])

# ---- group: floor num for each type
int_18 = Integer(merge_4)

# ----
multiplication_6 = Multiplication(A=int_18, B=panel_6)

# ---- group: building height for each type
num_7 = Number(multiplication_6)

# ----
panel_26 = Panel(num_7)
item_27 = ListItem(List=pshift_9, Index=1, Wrap=False)
item_28 = ListItem(List=pshift_10, Index=1, Wrap=False)

# ---- group: dockID
int_19 = Integer(item_28)

int_20 = Integer(item_28)

# ----
item_29 = ListItem(List=pshift_12, Index=1, Wrap=False)

# ---- group: slider1
num_8 = Number(item_29)

num_9 = Number(item_29)

# ----
item_30 = ListItem(List=pshift_13, Index=1, Wrap=False)

# ---- group: toggle1
bool = Boolean(item_30)

bool_2 = Boolean(item_30)

# ----
panel_27 = Panel(bool_2)

# ---- group: toggle1
bool_3 = Boolean(panel_27)

# ---- group: traffic mode is PEV
bool_4 = Boolean(bool_3)

bool_5 = Boolean(bool_3)  # disabled

# ---- group: toggle1
bool_6 = Boolean(bool_3)

# ----
filter_2 = StreamFilter(Gate=bool_6, Stream0=scale_nu.Geometry, Stream1=scale_nu_5.Geometry)
filter_3 = StreamFilter(Gate=bool_6, Stream0=scale_nu_2.Geometry, Stream1=scale_nu_6.Geometry)

# ---- group: toggle1
bool_7 = Boolean(bool_3)

# ----
filter_4 = StreamFilter(Gate=bool_7, Stream0=scale_nu_3.Geometry, Stream1=scale_nu_7.Geometry)
filter_5 = StreamFilter(Gate=bool_7, Stream0=scale_nu_4.Geometry, Stream1=scale_nu_8.Geometry)
mesh_34 = Mesh(filter_3)
mesh_35 = Mesh(filter_2)
mesh_36 = Mesh(filter_5)
mesh_37 = Mesh(filter_4)
filter_6 = StreamFilter(Gate=bool_6, Stream0=pt_8, Stream1=pt_12)
filter_7 = StreamFilter(Gate=bool_6, Stream0=pt_10, Stream1=pt_14)
filter_8 = StreamFilter(Gate=bool_7, Stream0=pt_9, Stream1=pt_13)
filter_9 = StreamFilter(Gate=bool_7, Stream0=pt_11, Stream1=pt_15)
pt_20 = Point(filter_7)
pt_21 = Point(filter_6)
pt_22 = Point(filter_9)
pt_23 = Point(filter_8)
item_31 = ListItem(List=pshift_14, Index=1, Wrap=False)

# ---- group: toggle2
bool_8 = Boolean(item_31)

bool_9 = Boolean(item_31)

# ----
item_32 = ListItem(List=pshift_15, Index=1, Wrap=False)

# ---- group: gridExtent_x
int_21 = Integer(item_32)

int_22 = Integer(item_32)

# ----
division_2 = Division(A=dist, B=int_21)

# ---- group: cell size
num_10 = Number(division_2)

num_11 = Number(division_2)

# ----
division_3 = Division(A=num_11, B=2)
multiplication_7 = Multiplication(A=division_3, B=Slider(0.95, range=0..1))
neg_3 = Negative(Value=multiplication_7)
dom_7 = ConstructDomain(DomainStart=neg_3, DomainEnd=multiplication_7)
multiplication_8 = Multiplication(A=panel_8, B=num_10)  # disabled
multiplication_9 = Multiplication(A="8", B=num_10)
pt_24 = ConstructPoint(XCoordinate=multiplication_8, YCoordinate=0, ZCoordinate=0)  # disabled
pt_25 = ConstructPoint(XCoordinate=multiplication_9, YCoordinate=0, ZCoordinate=0)
yz_2 = YZPlane(Origin=pt_24)  # disabled
yz_3 = YZPlane(Origin=pt_25)
mirror_2 = Mirror(Geometry=move_4.Geometry, Plane=yz_2)  # -> Geometry, Transform; disabled
mirror_3 = Mirror(Geometry=move_5.Geometry, Plane=yz_3)  # -> Geometry, Transform

# ---- group: gridExtent_x
# Dashboard
int_23 = Integer(item_32)

# ---- group: cell size
num_12 = Number(division_2)

# ----
division_4 = Division(A=num_12, B=2.5)
division_5 = Division(A=num_11, B=2)
neg_4 = Negative(Value=division_4)

# ---- group: cell area
sqr = Square(Value=num_11)

# ----
multiplication_10 = Multiplication(A=sqr, B=Slider(0.25, range=0..1))
num_13 = Number(multiplication_10)
dom_8 = ConstructDomain(DomainStart=neg_4, DomainEnd=division_4)

# ---- group: ppl per m2
multiplication_11 = Multiplication(A=num_13, B="0.018181")
multiplication_12 = Multiplication(A=num_13, B="0.05454")
multiplication_13 = Multiplication(A=num_13, B="0.0666667")
multiplication_14 = Multiplication(A=num_13, B="0.01123")
multiplication_15 = Multiplication(A=num_13, B="0.2")
multiplication_16 = Multiplication(A=num_13, B="0.0337")

# ----
panel_28 = Panel(multiplication_11)
panel_29 = Panel(multiplication_14)
panel_30 = Panel(multiplication_13)
panel_31 = Panel(multiplication_16)
panel_32 = Panel(multiplication_12)
panel_33 = Panel(multiplication_15)
item_33 = ListItem(List=pshift_16, Index=1, Wrap=False)
item_34 = ListItem(List=pshift_17, Index=1, Wrap=False)

# ---- group: toggle2
bool_10 = Boolean(item_34)

bool_11 = Boolean(item_34)

# ----
swatch_6 = ColourSwatch(SwatchColor=RGB(201, 201, 201))
rnd_reduce_by_ratio = RndReduceByRatio(L=align.Plane, B=Slider(0.86, range=0..1), S=Slider(65, range=0..100))
pt_26 = Point(<point referenced from the Rhino model>)
pt_27 = Point(<point referenced from the Rhino model>)
pt_28 = Point(<point referenced from the Rhino model>)
pt_29 = Point(<point referenced from the Rhino model>)

# ---- group: dockRotation
int_24 = Integer(item_26)

# ---- group: IDMax
int_25 = Integer(item_27)

# ---- group: dockID
int_26 = Integer(item_28)

# ----
item_35 = ListItem(List=txt_15, Index=int_26, Wrap=False)
item_36 = ListItem(List=txt_16, Index=int_26, Wrap=False)

# ---- group: slider1
num_14 = Number(item_29)

num_15 = Number(num_14)

# ----
multiplication_17 = Multiplication(A=num_15, B=100)
int_27 = Integer(multiplication_17)
item_37 = ListItem(List=txt_14, Index=int_27, Wrap=True)

# ---- group: toggle1
bool_12 = Boolean(item_30)

# ----
item_38 = ListItem(List=txt_17, Index=bool_12, Wrap=True)

# ---- group: toggle2
bool_13 = Boolean(item_31)

# ---- group: gridExtent_x
int_28 = Integer(item_32)

# ---- group: gridIndex
int_29 = Integer(item_33)

# ---- group: toggle2
bool_14 = Boolean(item_34)

# ----
mesh_38 = Mesh(mesh_30)
pln_2 = Plane(rnd_reduce_by_ratio)

# ---- group: office list
tag = TextTag3D(Location=pt_26, Text=item_35, Size=number_slider_20, Colour=swatch_6, Justification=5)

# ---- group: fl # slider
tag_2 = TextTag3D(Location=pt_27, Text=item_37, Size=number_slider_20, Colour=swatch_6, Justification=8)

# ---- group: residential list
tag_3 = TextTag3D(Location=pt_28, Text=item_36, Size=number_slider_20, Colour=swatch_6, Justification=5)

# ---- group: transportation mode
tag_4 = TextTag3D(Location=pt_29, Text=item_38, Size=number_slider_20, Colour=swatch_6, Justification=5)

# ----
panel_34 = Panel(int_24)
panel_35 = Panel(int_25)
panel_36 = Panel(int_26)
panel_37 = Panel(num_14)
panel_38 = Panel(bool_12)
panel_39 = Panel(bool_13)
panel_40 = Panel(int_28)
panel_41 = Panel(int_29)
panel_42 = Panel(bool_14)
orient = Orient(Geometry=mesh_38, Source=PlaneXY(0, 0, 0), Target=pln_2)  # -> Geometry, Transform
number_slider_21 = Slider(11.8, range=0..100)
mjoin_2 = MeshJoin(Meshes=orient.Geometry)
item_39 = ListItem(List=pshift_15, Index=2, Wrap=False)

# ---- group: gridExtent_y
int_30 = Integer(item_39)

int_31 = Integer(item_39)

int_32 = Integer(item_39)

# ----
mcol_3 = MeshColours(Mesh=mjoin_2, Colours=ColourSwatch(SwatchColor=RGB(255, 255, 255)))

# ---- group: gridExtent_y
int_33 = Integer(item_39)

# ----
item_40 = ListItem(List=mesh_16, Index=int_26, Wrap=False)
pt_30 = Point(<point referenced from the Rhino model>)
pt_31 = Point(<point referenced from the Rhino model>)
neg_5 = Negative(Value=int_24)
panel_43 = Panel(int_33)
subtraction = Subtraction(A=int_28, B=1)
rotate = Rotate(Geometry=item_40, Angle=degrees(neg_5), Plane=PlaneXY(0, 0, 0))  # -> Geometry, Transform
mesh_39 = Mesh(mcol_3)
vec2pt_2 = Vector2Pt(PointA=Point(0, 0, 0), PointB=pt_31, Unitize=False)  # -> Vector, Length
multiplication_18 = Multiplication(A=int_28, B=int_33)
split_14 = SplitList(List=pshift_4, Index=multiplication_18)  # -> ListA, ListB
pshift_18 = ShiftPaths(Data=split_14.ListA, Offset=-1)
split_15 = TextSplit(Text=pshift_18, Separators="\t")
pshift_19 = ShiftPaths(Data=split_15, Offset=1)

# ---- group: all data
int_34 = Integer(pshift_19)

# ----
panel_44 = Panel(int_34)
item_41 = ListItem(List=int_34, Index="3", Wrap=False)
item_42 = ListItem(List=int_34, Index="0", Wrap=False)
item_43 = ListItem(List=int_34, Index="1", Wrap=False)
item_44 = ListItem(List=int_34, Index="2", Wrap=False)
pshift_20 = ShiftPaths(Data=item_42, Offset=-1)
pshift_21 = ShiftPaths(Data=item_43, Offset=-1)
pshift_22 = ShiftPaths(Data=item_44, Offset=-1)
pshift_23 = ShiftPaths(Data=item_41, Offset=-1)
neg_6 = Negative(Value=pshift_23)

# ---- group: module id
int_35 = Integer(pshift_20)

int_36 = Integer(int_35)

int_37 = Integer(int_35)

# ----
larger = LargerThan(FirstNumber=int_36, SecondNumber="0")  # -> LargerThan, OrEqualTo
smaller = SmallerThan(FirstNumber=int_36, SecondNumber="5")  # -> SmallerThan, OrEqualTo
and_2 = GateAnd(A=larger.OrEqualTo, B=smaller.OrEqualTo)

# ---- group: is building or not
bool_15 = Boolean(and_2)

# ----
dispatch_5 = Dispatch(List=int_36, DispatchPattern=bool_15)  # -> ListA, ListB

# ---- group: building id
int_38 = Integer(dispatch_5.ListA)

# ----
larger_2 = LargerThan(FirstNumber=int_37, SecondNumber="0")  # -> LargerThan, OrEqualTo
smaller_2 = SmallerThan(FirstNumber=int_37, SecondNumber="5")  # -> SmallerThan, OrEqualTo
and_3 = GateAnd(A=larger_2.OrEqualTo, B=smaller_2.OrEqualTo)
# Human Dots @ Lego
dispatch_6 = Dispatch(List=int_37, DispatchPattern=and_3)  # -> ListA, ListB

# ---- group: filted id
int_39 = Integer(dispatch_6.ListA)

# ----
dispatch_7 = Dispatch(List=int_37, DispatchPattern=and_3)  # -> ListA, ListB; disabled
item_45 = ListItem(List=txt_18, Index=graft(int_39), Wrap=True)
item_46 = ListItem(List=txt_18, Index=graft(dispatch_7.ListA), Wrap=True)  # disabled
pshift_24 = ShiftPaths(Data=item_45, Offset=-1)
pshift_25 = ShiftPaths(Data=item_46, Offset=-1)  # disabled

# ---- group: flr #s
txt_19 = Text(pshift_24)

# ----
txt_20 = Text(pshift_25)  # disabled
filter_10 = StreamFilter(Gate=show_google_map, Stream0=txt_20)  # disabled
dispatch_8 = Dispatch(List=int_37, DispatchPattern=and_3)  # -> ListA, ListB
txt_21 = Text(filter_10)  # disabled
smaller_3 = SmallerThan(FirstNumber=int_37, SecondNumber="0")  # -> SmallerThan, OrEqualTo
item_47 = ListItem(List=mesh_16, Index=graft(dispatch_8.ListA), Wrap=False)
item_48 = ListItem(List=panel_26, Index=graft(int_38), Wrap=False)
pshift_26 = ShiftPaths(Data=item_47, Offset=-1)
item_49 = ListItem(List=num_6, Index=graft(int_39), Wrap=True)
item_50 = ListItem(List=num_4, Index=graft(int_39), Wrap=True)
item_51 = ListItem(List=num_5, Index=graft(int_39), Wrap=True)
pshift_27 = ShiftPaths(Data=item_48, Offset=-1)
pshift_28 = ShiftPaths(Data=item_49, Offset=-1)
pshift_29 = ShiftPaths(Data=item_50, Offset=-1)
pshift_30 = ShiftPaths(Data=item_51, Offset=-1)
multiplication_19 = Multiplication(A=pshift_27, B=number_slider_11)

# ---- group: building height of each building
num_16 = Number(multiplication_19)

# ----
addition = Addition(A=num_16, B=panel_7)
dom_9 = ConstructDomain(DomainStart=0, DomainEnd=addition)
equals_2 = Equality(FirstNumber=int_37, SecondNumber="7")  # -> Equality, Inequality
equals_3 = Equality(FirstNumber=int_37, SecondNumber="6")  # -> Equality, Inequality

# ---- group: old per flr
num_17 = Number(pshift_28)

# ---- group: young per flr
num_18 = Number(pshift_29)

# ---- group: mid per flr
num_19 = Number(pshift_30)

# ----
multiplication_20 = Multiplication(A=num_19, B=txt_19)
multiplication_21 = Multiplication(A=num_18, B=txt_19)
multiplication_22 = Multiplication(A=num_17, B=txt_19)
or = GateOr(A=equals_3.Equality, B=equals_2.Equality)

# ---- group: total ppl in building mid
int_40 = Integer(multiplication_20)

# ---- group: total ppl in building young
int_41 = Integer(multiplication_21)

# ---- group: total ppl in building old
int_42 = Integer(multiplication_22)

# ---- group: module id
int_43 = Integer(int_35)

# ----
equals_4 = Equality(FirstNumber=int_43, SecondNumber="0")  # -> Equality, Inequality
equals_5 = Equality(FirstNumber=int_43, SecondNumber="1")  # -> Equality, Inequality
equals_6 = Equality(FirstNumber=int_43, SecondNumber="3")  # -> Equality, Inequality
equals_7 = Equality(FirstNumber=int_43, SecondNumber="2")  # -> Equality, Inequality
equals_8 = Equality(FirstNumber=int_43, SecondNumber="4")  # -> Equality, Inequality
equals_9 = Equality(FirstNumber=int_43, SecondNumber="5")  # -> Equality, Inequality
int_44 = Integer(equals_4.Equality)
int_45 = Integer(equals_5.Equality)
int_46 = Integer(equals_6.Equality)
int_47 = Integer(equals_7.Equality)
int_48 = Integer(equals_8.Equality)
int_49 = Integer(equals_9.Equality)
ma = MassAddition(Input=int_44)  # -> Result, PartialResults
ma_2 = MassAddition(Input=int_45)  # -> Result, PartialResults
ma_3 = MassAddition(Input=int_46)  # -> Result, PartialResults
ma_4 = MassAddition(Input=int_47)  # -> Result, PartialResults
ma_5 = MassAddition(Input=int_48)  # -> Result, PartialResults
ma_6 = MassAddition(Input=int_49)  # -> Result, PartialResults
int_50 = Integer(ma.Result)
panel_45 = Panel(int_50)
int_51 = Integer(ma_2.Result)
panel_46 = Panel(int_51)
int_52 = Integer(ma_3.Result)
panel_47 = Panel(int_52)
int_53 = Integer(ma_4.Result)
panel_48 = Panel(int_53)
int_54 = Integer(ma_5.Result)
panel_49 = Panel(int_54)
int_55 = Integer(ma_6.Result)
panel_50 = Panel(int_55)

# ---- group: Micro-unit Building #
int_56 = Integer(int_53)

# ---- group: Regular residential Building #
int_57 = Integer(int_51)

# ---- group: Luxury Building #
int_58 = Integer(int_50)

# ---- group: Head Quater Building #
int_59 = Integer(int_52)

# ---- group: Regular Office Building #
int_60 = Integer(int_54)

# ---- group: Co-working Building #
int_61 = Integer(int_55)

# ----
multiplication_23 = Multiplication(A=int_15, B=int_60)
multiplication_24 = Multiplication(A=int_7, B=int_57)
multiplication_25 = Multiplication(A=int_17, B=int_61)
multiplication_26 = Multiplication(A=int_9, B=int_56)
multiplication_27 = Multiplication(A=int_13, B=int_59)
multiplication_28 = Multiplication(A=int_5, B=int_58)

multiplication_29 = Multiplication(A=panel_32, B=multiplication_23)
multiplication_30 = Multiplication(A=panel_28, B=multiplication_24)
multiplication_31 = Multiplication(A=panel_33, B=multiplication_25)
multiplication_32 = Multiplication(A=panel_30, B=multiplication_26)
multiplication_33 = Multiplication(A=panel_31, B=multiplication_27)
multiplication_34 = Multiplication(A=panel_29, B=multiplication_28)

# ---- group: Head Quater ppl #
int_62 = Integer(multiplication_33)

# ---- group: Co-working ppl #
int_63 = Integer(multiplication_31)

# ---- group: Micro-unit ppl #
int_64 = Integer(multiplication_32)

# ---- group: Luxury ppl #
int_65 = Integer(multiplication_34)

# ---- group: Regular residential ppl #
int_66 = Integer(multiplication_30)

# ---- group: Regular Office ppl #
int_67 = Integer(multiplication_29)

# ----
join = TextJoin(Text=flatten([" - Regular: ", int_66]))
join_2 = TextJoin(Text=flatten([" - Micro-unit: ", int_64]))
join_3 = TextJoin(Text=flatten([" - Luxury: ", int_65]))
ma_7 = MassAddition(Input=[int_63, int_67, int_62])  # -> Result, PartialResults
ma_8 = MassAddition(Input=[int_64, int_66, int_65])  # -> Result, PartialResults

# ---- group: total working ppl #
int_68 = Integer(ma_7.Result)

# ---- group: total residential ppl #
int_69 = Integer(ma_8.Result)

# ----
join_4 = TextJoin(Text=flatten(["Residential: ", int_69]))
join_5 = TextJoin(Text=[join_4, join_2, join, join_3])

# ---- group: residential list
tag_5 = TextTag3D(Location=pt_19, Text=join_5, Size=number_slider_19, Colour=ColourSwatch(SwatchColor=RGB(201, 201, 201)), Justification=1)

# ----
addition_2 = Addition(A=int_69, B=int_68)

# ---- group: total ppl #
int_70 = Integer(addition_2)

int_71 = Integer(int_70)

# Traffic Heatmap - Yasushi
int_72 = Integer(int_70)  # disabled

# ----
int_73 = Integer(int_71)
int_74 = Integer(int_72)  # disabled
congestion = PythonScript(A=crossings, S=srf, P=pt_3, N=int_73, B=bool_4)  # -> out, C, t; inputs A: list, P: list
# ---------- congestion: Python ----------
import random 
import rhinoscriptsyntax as rs

ratio = float((N-700)/(35000.0-700.0))

C=[]
t=[]

#print ratio

hue = 50 - 50 * ratio
alpha = 255 * ratio

if B :
    hue += 45
    alpha /= float(3)

min_distance = []

for p in P:
    mind = 10000000
    for a in A:
        d = rs.Distance(a,p)
        if d < mind:
            mind = d
    distance =  (1-mind/250) * 0.2 
    hue += distance*2
    if not B:
        t.append((60-hue)*1.5)
    else:
        t.append((100-hue)*0.5)
    C.append(rs.ColorHLSToRGB((hue+random.randint(-2,2),128,255,alpha+random.randint(-5,5))));
# ---------- end congestion ----------
congestion_2 = PythonScript(A=crossings_2, S=srf_2, P=pt_4, N=int_74, B=bool_5)  # -> out, C, t; inputs A: list, P: list; disabled; same code as congestion
gradient = Gradient(
    LowerLimit=0,
    UpperLimit=100,
    Parameter=congestion.t,
    stops=[0: RGB(0, 128, 0), 0.301: RGB(255, 255, 0), 0.592: RGB(255, 0, 0)])
gradient_2 = Gradient(LowerLimit=0, UpperLimit=100, Parameter=congestion_2.t, stops=[0: RGB(79, 79, 79), 0.793: RGB(173, 0, 0)])  # disabled
pshift_31 = ShiftPaths(Data=gradient, Offset=-1)
pshift_32 = ShiftPaths(Data=gradient_2, Offset=-1)  # disabled
graft_5 = GraftTree(Tree=pshift_31, IncludeEmptyLists=True, IncludeNullItems=True)
graft_6 = GraftTree(Tree=pshift_32, IncludeEmptyLists=True, IncludeNullItems=True)  # disabled
mspray = MeshSpray(Mesh=graft, Points=Point(0, 0, 0), Colours=graft_5, SprayMode=0)
mspray_2 = MeshSpray(Mesh=graft_3, Points=Point(0, 0, 0), Colours=graft_5, SprayMode=0)
mspray_3 = MeshSpray(Mesh=graft_2, Points=Point(0, 0, 0), Colours=graft_6, SprayMode=0)  # disabled
mspray_4 = MeshSpray(Mesh=graft_4, Points=Point(0, 0, 0), Colours=graft_6, SprayMode=0)  # disabled
mjoin_3 = MeshJoin(Meshes=flatten(mspray))
mjoin_4 = MeshJoin(Meshes=flatten(mspray_2))
mjoin_5 = MeshJoin(Meshes=flatten(mspray_3))  # disabled
mjoin_6 = MeshJoin(Meshes=flatten(mspray_4))  # disabled
filter_11 = StreamFilter(Gate=show_google_map, Stream0=mjoin_3)
filter_12 = StreamFilter(Gate=show_google_map, Stream0=mjoin_5)  # disabled

# ---- group: road traffic 3D
mesh_40 = Mesh(mjoin_4)

mesh_41 = Mesh(mjoin_6)  # disabled

# ---- group: road traffic lego
mesh_42 = Mesh(filter_11)

mesh_43 = Mesh(filter_12)  # disabled

# ----
panel_51 = Panel(congestion.t)
panel_52 = Panel(congestion_2.t)  # disabled
# Human Interaction
amenities = PythonScript(N=int_70)  # -> out, A
# ---------- amenities: Python ----------
import math

title = ["density","subway_station","department_store","embassy","beauty_salon","police","courthouse","cemetery","pharmacy","local_government_office","shopping_mall","city_hall","rv_park","shoe_store","bank","bowling_alley","school","bar","university","car_dealer","taxi_stand","grocery_or_supermarket","fire_station","church","convenience_store","campground","lawyer","parking","post_office","hindu_temple","hardware_store","meal_takeaway","movie_rental","gas_station","funeral_home","aquarium","restaurant","home_goods_store","atm","veterinary_care","airport","locksmith","bus_station","hospital","night_club","electrician","mosque","amusement_park","lodging","florist","liquor_store","museum","car_rental","stadium","store","hair_care","transit_station","meal_delivery","gym","park","dentist","library","book_store","painter","roofing_contractor","moving_company","clothing_store","furniture_store","physiotherapist","casino","art_gallery","car_wash","movie_theater","spa","accounting","cafe","car_repair","synagogue","real_estate_agency","electronics_store","doctor","bicycle_store","storage","zoo","train_station","jewelry_store","laundry","insurance_agency","plumber","pet_store","bakery","travel_agency"]

newyork = [27673,10,6,10,74,3,0,0,29,27,16,0,0,28,111,2,35,200,6,13,0,20,2,13,23,1,200,89,6,0,0,74,5,0,0,0,200,102,183,2,1,7,41,22,60,16,0,0,140,12,7,9,7,0,200,60,51,28,35,13,135,31,18,5,1,28,200,21,46,1,26,1,35,39,200,96,18,0,200,105,200,2,11,0,0,200,29,200,9,2,37,177]
atlanta = [700,0,0,0,15,0,0,0,3,2,1,0,0,2,4,0,4,31,1,0,0,2,1,5,3,0,200,10,0,0,1,4,0,1,0,0,46,13,7,1,0,0,11,8,7,0,0,0,5,0,1,1,0,0,59,15,11,2,7,0,25,0,0,2,1,1,8,7,2,0,3,1,0,11,8,9,3,0,22,3,58,0,0,0,0,0,6,22,2,2,2,4]

ratio = (N - atlanta[0]) / float(newyork[0] - atlanta[0])
print ratio

amenities = {}

for i in range(len(title))[1:]:
    amenity =  title[i]
    num =  math.floor(atlanta[i]+(newyork[i]-atlanta[i]) * ratio)
    
    if title[i].startswith('law'): continue
    if title[i].startswith('jew'): continue
    if title[i].startswith('accoun'): continue
    if title[i].startswith('store'): continue
    if title[i].startswith('travel'): continue
    if title[i].startswith('cloth'): continue
    if title[i].startswith('local_'): continue
    if title[i].startswith('electronic'): continue
    if title[i].startswith('dent'): continue
    if title[i].startswith('insu'): continue
    if title[i].startswith('physio'): continue
    if title[i].startswith('real'): continue
    if title[i].startswith('doc'): continue
    if title[i].startswith('storage'): continue
    if title[i].startswith('painter'): continue
    if title[i].startswith('moving'): continue
    if title[i].startswith('subway'): continue
    if title[i].startswith('meal'): continue
    if title[i].startswith('embassy'): continue
    if title[i].startswith('shoe'): continue
    
    if num > 2:
        amenities[title[i]] = num

result = []
cnt = 0

for amenity in sorted(amenities, key=lambda k: amenities[k], reverse=True):
    cnt += 1
    if cnt%4 <= 1 : continue
    result.append('{}: {}'.format(amenity,int(amenities[amenity])))
    

print result

A = result
# ---------- end amenities ----------
panel_53 = Panel(amenities.A)
join_6 = TextJoin(Text=panel_53)

# ---- group: amenity list
tag_6 = TextTag3D(
    Location=pt_17,
    Text=join_6,
    Size=Slider(11.8, range=0..100),
    Colour=ColourSwatch(SwatchColor=RGB(201, 201, 201)),
    Justification=1)

# ----
join_7 = TextJoin(Text=flatten(["Office: ", int_68]))
join_8 = TextJoin(Text=flatten([" - Regular: ", int_67]))
join_9 = TextJoin(Text=flatten([" - Co-working: ", int_63]))
join_10 = TextJoin(Text=flatten([" - Headquarter: ", int_62]))
join_11 = TextJoin(Text=[join_7, join_9, join_8, join_10])
panel_54 = Panel(int_70)

# ---- group: residential list
tag_7 = TextTag3D(
    Location=pt_30,
    Text=join_11,
    Size=number_slider_19,
    Colour=ColourSwatch(SwatchColor=RGB(201, 201, 201)),
    Justification=1)

# ----
subtraction_2 = Subtraction(A=subtraction, B=pshift_21)

# ---- group: x
int_75 = Integer(subtraction_2)

int_76 = Integer(int_75)

int_77 = Integer(int_75)

int_78 = Integer(int_75)

# ---- group: y
int_79 = Integer(pshift_22)

int_80 = Integer(int_79)

int_81 = Integer(int_79)

# ---- group: road check matrix
python_2 = PythonScript(xe=int_21, ye=int_30, x=int_77, y=int_81, id=int_37)  # -> out, m; inputs x: list, y: list, id: list
# ---------- python_2: Python ----------
"""
CityMatrix

written by "Ryan" Yan Zhang <ryanz@mit.edu>
for MIT Media Lab, Changing Place Group
April.6th.2016
"""

import rhinoscriptsyntax as rs

m = [[-1 for n in range(xe)] for n in range(ye)]

#for n in range(len(id)):
#    if id[n] == 7:
#        m[y[n]][x[n]] = 6
#    else:
#        m[y[n]][x[n]] = id[n]

for n in range(len(id)):
    m[y[n]][x[n]] = id[n]

for n in range(ye):
    print m[n]
# ---------- end python_2 ----------

# ---- group: sidewalk check matrix
python_3 = PythonScript(xe=int_21, ye=int_30, x=int_77, y=int_81, id=int_37)  # -> out, m; inputs x: list, y: list, id: list; same code as python_2

# ----
modulecenter = ModuleCenter(pt=pt, num=num_10, int_2=int_77, int=int_81)  # -> pt_5, transform_2

# ---- group: road check list
python_4 = PythonScript(xe=int_21, ye=int_30, x=int_77, y=int_81, id=int_37, m=python_2.m)  # -> out, rdType; inputs x: list, y: list, id: list, m: list
# ---------- python_4: Python ----------
"""
CityMatrix

written by "Ryan" Yan Zhang <ryanz@mit.edu>
for MIT Media Lab, Changing Place Group
April.6th.2016
"""

import rhinoscriptsyntax as rs

rdType = []

for n in range(len(id)):
    
    code = []
    
    if id[n]==6:
        
        # 0: check x, y+1
        if y[n]+1>ye-1:
            code.append(1)
        else:
            if m[y[n]+1][x[n]]==6:
                code.append(1)
            else:
                code.append(0)
        
        # 1: check x+1, y
        if x[n]+1>xe-1:
            code.append(1)
        else:
            if m[y[n]][x[n]+1]==6:
                code.append(1)
            else:
                code.append(0)
        
        # 2: check x, y-1
        if y[n]-1<0:
            code.append(1)
        else:
            if m[y[n]-1][x[n]]==6:
                code.append(1)
            else:
                code.append(0)
        
        # 3: check x-1, y
        if x[n]-1<0:
            code.append(1)
        else:
            if m[y[n]][x[n]-1]==6:
                code.append(1)
            else:
                code.append(0)
    
    else:
        
        code = [0,0,0,0]
    
    print code
    rdType.append(code)
# ---------- end python_4 ----------

# ----
xform = Transform(modulecenter.transform_2)  # disabled

# ---- group: sidewalk check list
python_5 = PythonScript(xe=int_21, ye=int_30, x=int_77, y=int_81, id=int_37, m=python_3.m)  # -> out, rdType; inputs x: list, y: list, id: list, m: list; same code as python_4

# ---- group: module center
pt_32 = Point(modulecenter.pt_5)

pt_33 = Point(pt_32)

# ----
dispatch_9 = Dispatch(List=pt_33, DispatchPattern=bool_15)  # -> ListA, ListB

# ---- group: road check list
python_6 = PythonScript(pt=pt_32, id=int_37, rdType=python_4.rdType, rdQua0=mesh_35, c0=pt_21, rdQua1=mesh_34, c1=pt_20)  # -> out, allRoadMesh; inputs pt: list, id: list, rdType: list, rdQua0: list, rdQua1: list
# ---------- python_6: Python ----------
"""
CityMatrix

written by "Ryan" Yan Zhang <ryanz@mit.edu>
for MIT Media Lab, Changing Place Group
April.6th.2016
"""

import rhinoscriptsyntax as rs
import Rhino.Geometry as rg

allRoadMesh = []

for n in range(len(id)):
    
    if id[n]==6:
        
        for i in range(len(rdType[n])):
            t = rdType[n][i]
            v = rs.PointCoordinates(pt[n])
            if t == 0:
                c = rs.PointCoordinates(c0)
                vx = v[0]-c[0]
                vy = v[1]-c[1]
                new = rs.CopyObject(rdQua0[i],(vx,vy,0.))
            else:
                c = rs.PointCoordinates(c1)
                vx = v[0]-c[0]
                vy = v[1]-c[1]
                new = rs.CopyObject(rdQua1[i],(vx,vy,0.))
            allRoadMesh.append(new)
# ---------- end python_6 ----------

# ---- group: sidewalk check list
python_7 = PythonScript(pt=pt_32, id=int_37, rdType=python_5.rdType, rdQua0=mesh_37, c0=pt_23, rdQua1=mesh_36, c1=pt_22)  # -> out, allRoadMesh; inputs pt: list, id: list, rdType: list, rdQua0: list, rdQua1: list; same code as python_6

# ---- group: road mesh final!
mesh_44 = Mesh(python_7.allRoadMesh)

# ---- group: building center
pt_34 = Point(dispatch_9.ListA)

# ----
move_11 = Move(Geometry=mesh_44, Motion=vec)  # -> Geometry, Transform
box = DomainBox(Base=pt_34, X=dom_7, Y=dom_7, Z=dom_9)
dispatch_10 = Dispatch(List=pt_32, DispatchPattern=smaller_3.SmallerThan)  # -> ListA, ListB
vec2pt_3 = Vector2Pt(PointA=Point(0, 0, 0), PointB=dispatch_10.ListA, Unitize=False)  # -> Vector, Length
move_12 = Move(Geometry=box, Motion=vec)  # -> Geometry, Transform
dispatch_11 = Dispatch(List=pt_32, DispatchPattern=and_3)  # -> ListA, ListB
move_13 = Move(Geometry=mesh_17, Motion=vec2pt_3.Vector)  # -> Geometry, Transform

# ---- group: building geo
box_2 = Box(move_12.Geometry)

# ---- group: textured buildings
panel_55 = Panel("C:\Users\RYAN\Documents\GitHub\CityMatrix\Map\PEV_PSG AND PKG_300DPI.png")  # disabled
panel_56 = Panel("0.01")  # disabled
swatch_7 = ColourSwatch(SwatchColor=RGB(255, 255, 255))  # disabled
boxmap = BoxMapping(Mesh=box_2, Box=box_2)  # disabled
previewmat_3 = CustomPreviewMaterials(Geometry=boxmap, DiffuseColor=swatch_7, Transparency=panel_56, DiffuseBitmap=panel_55)  # disabled

# ----
vec2pt_4 = Vector2Pt(PointA=Point(0, 0, 0), PointB=dispatch_11.ListA, Unitize=False)  # -> Vector, Length
dispatch_12 = Dispatch(List=pt_32, DispatchPattern=or)  # -> ListA, ListB

# ---- group: road
mesh_45 = Mesh(move_11.Geometry)

# ---- group: road mesh final!
mesh_46 = Mesh(python_6.allRoadMesh)

# ---- group: road center pts
pt_35 = Point(dispatch_12.ListA)

# ---- group: blank
mesh_47 = Mesh(move_13.Geometry)

mesh_48 = Mesh(mesh_47)

# ----
move_14 = Move(Geometry=mesh_48, Motion=vec)  # -> Geometry, Transform

# ---- group: blank
mesh_49 = Mesh(move_14.Geometry)

# ----
easter_eggs = EasterEggs(L=pt_32, A_2=int_37, shrink=cell_shrink, L_2=pt_32, A=int_37, shrink_2=cell_shrink)  # disabled

# ---- group: sidewalk mesh final!
mesh_50 = Mesh(python_7.allRoadMesh)

# ----
filter_13 = StreamFilter(Gate=show_google_map, Stream0=mesh_46)
filter_14 = StreamFilter(Gate=show_google_map, Stream0=mesh_47)
filter_15 = StreamFilter(Gate=show_google_map, Stream0=mesh_50)

# ---- group: road mesh final!
mesh_51 = Mesh(filter_13)

mesh_52 = Mesh(mesh_51)

mesh_53 = Mesh(mesh_51)  # disabled

# ---- group: blank
mesh_54 = Mesh(filter_14)

# ---- group: sidewalk mesh final!
mesh_55 = Mesh(filter_15)

# ---- group: y
int_82 = Integer(int_79)

# ---- group: blank modules
mesh_56 = Mesh(mesh_47)

# ----
geobottomcenter = GeoBottomCenter_2(geo=mesh_56)
lng = ListLength(List=geobottomcenter)
division_6 = Division(A=int, B=lng)
randomsplit = RandomSplitList(MasterList=geobottomcenter, Seed=Slider(32, range=0..100), Split=division_6)  # -> ListA, ListB
lng_2 = ListLength(List=randomsplit.ListA)
division_7 = Division(A=int_2, B=lng_2)
randomsplit_2 = RandomSplitList(MasterList=randomsplit.ListA, Seed=Slider(25, range=0..100), Split=division_7)  # -> ListA, ListB

# ---- group: parking center
pt_36 = Point(randomsplit.ListB)

# ---- group: park center lego
pt_37 = Point(randomsplit_2.ListB)

# ----
move_15 = Move(Geometry=pt_37, Motion=vec_2)  # -> Geometry, Transform

# ---- group: park center 3D
pt_38 = Point(move_15.Geometry)

# ----
planesrf_3 = PlaneSurface(Plane=pt_38, XSize=dom_8, YSize=dom_8)
lng_3 = ListLength(List=pt_38)
random = Random(Range="0.8 to 1.4", Number=lng_3, Seed=Slider(72, range=0..100))
multiplication_35 = Multiplication(A=random, B=tree_scale)
scale = Scale(Geometry=mesh_33, Center=Point(0, 0, 0), Factor=multiplication_35)  # -> Geometry, Transform
random_2 = Random(Range=dom_6, Number=lng_3, Seed=Slider(17, range=0..100))
random_3 = Random(Range=Domain(0, 1000), Number=lng_3, Seed=Slider(35, range=0..100))
vec2pt_5 = Vector2Pt(PointA=Point(0, 0, 0), PointB=pt_37, Unitize=False)  # -> Vector, Length
vec2pt_6 = Vector2Pt(PointA=Point(0, 0, 0), PointB=pt_36, Unitize=False)  # -> Vector, Length
popgeo = PopulateGeometry(Geometry=flatten(planesrf_3), Count=flatten(random_2), Seed=flatten(random_3))
move_16 = Move(Geometry=mesh_32, Motion=vec2pt_5.Vector)  # -> Geometry, Transform
move_17 = Move(Geometry=mesh_31, Motion=vec2pt_6.Vector)  # -> Geometry, Transform

# ---- group: tree center
pt_39 = Point(flatten(popgeo))

# ----
vec2pt_7 = Vector2Pt(PointA=Point(0, 0, 0), PointB=pt_39, Unitize=False)  # -> Vector, Length
move_18 = Move(Geometry=scale.Geometry, Motion=vec2pt_7.Vector)  # -> Geometry, Transform

# ---- group: parking lego
mesh_57 = Mesh(move_16.Geometry)

# ----
move_19 = Move(Geometry=mesh_57, Motion=vec_2)  # -> Geometry, Transform

# ---- group: parking 3D
mesh_58 = Mesh(move_19.Geometry)

# ---- group: parking lego
mesh_59 = Mesh(move_17.Geometry)

# ----
move_20 = Move(Geometry=mesh_59, Motion=vec_2)  # -> Geometry, Transform

# ---- group: parking 3D
mesh_60 = Mesh(move_20.Geometry)

# ---- group: trees 3D
mesh_61 = Mesh(move_18.Geometry)

# ----
filter_16 = StreamFilter(Gate=show_google_map, Stream0=mesh_57)
filter_17 = StreamFilter(Gate=show_google_map, Stream0=mesh_59)

# ---- group: parking lego
mesh_62 = Mesh(filter_16)

mesh_63 = Mesh(filter_17)

# ---- group: rotation
int_83 = Integer(neg_6)

int_84 = Integer(int_83)

int_85 = Integer(int_83)

# ----
dispatch_13 = Dispatch(List=int_85, DispatchPattern=and_3)  # -> ListA, ListB
rotate_2 = Rotate(Geometry=pshift_26, Angle=degrees(dispatch_13.ListA), Plane=PlaneXY(0, 0, 0))  # -> Geometry, Transform
graft_7 = GraftTree(Tree=rotate_2.Transform, IncludeEmptyLists=True, IncludeNullItems=True)  # disabled
graft_8 = GraftTree(Tree=rotate_2.Transform, IncludeEmptyLists=True, IncludeNullItems=True)
move_21 = Move(Geometry=rotate_2.Geometry, Motion=vec2pt_4.Vector)  # -> Geometry, Transform
pshift_33 = ShiftPaths(Data=move_21.Transform, Offset=-1)  # disabled
pshift_34 = ShiftPaths(Data=move_21.Transform, Offset=-1)
graft_9 = GraftTree(Tree=pshift_33, IncludeEmptyLists=True, IncludeNullItems=True)  # disabled
graft_10 = GraftTree(Tree=pshift_34, IncludeEmptyLists=True, IncludeNullItems=True)
comp = Compound(Transforms=[graft_7, graft_9])  # disabled
comp_2 = Compound(Transforms=[graft_8, graft_10])
transform = Transform(Geometry=xy_2, Transform=comp)  # disabled
transform_2 = Transform(Geometry=xy_3, Transform=comp_2)
pshift_35 = ShiftPaths(Data=transform, Offset=-1)  # disabled
pshift_36 = ShiftPaths(Data=transform_2, Offset=-1)

# ---- group: people dots base plans
pln_3 = Plane(pshift_36)

# ---- group: block #
lng_4 = ListLength(List=pln_3)

# ---- group: seed d
random_4 = Random(Range=Domain(0, 10000), Number=lng_4, Seed=Slider(17, range=0..100))

# ---- group: seed r
random_5 = Random(Range=Domain(0, 10000), Number=lng_4, Seed=number_slider_4)

# ---- group: seed d
random_6 = Random(Range=Domain(0, 10000), Number=lng_4, Seed=Slider(51, range=0..100))

random_7 = Random(Range=Domain(0, 10000), Number=lng_4, Seed=Slider(46, range=0..100))

# ---- group: seed r
random_8 = Random(Range=Domain(0, 10000), Number=lng_4, Seed=number_slider_5)

random_9 = Random(Range=Domain(0, 10000), Number=lng_4, Seed=Slider(69, range=0..100))

# ----
pshift_37 = ShiftPaths(Data=random_5, Offset=-1)
pshift_38 = ShiftPaths(Data=random_4, Offset=-1)
pshift_39 = ShiftPaths(Data=random_8, Offset=-1)
pshift_40 = ShiftPaths(Data=random_9, Offset=-1)
pshift_41 = ShiftPaths(Data=random_6, Offset=-1)
pshift_42 = ShiftPaths(Data=random_7, Offset=-1)

# ---- group: d
random_10 = Random(Range=Domain(0, 1), Number=int_41, Seed=pshift_38)

# ---- group: r
random_11 = Random(Range=Domain(0, 360), Number=int_41, Seed=pshift_37)

# ---- group: d
random_12 = Random(Range=Domain(0, 1), Number=int_40, Seed=pshift_41)

random_13 = Random(Range=Domain(0, 1), Number=int_42, Seed=pshift_42)

# ---- group: r
random_14 = Random(Range=Domain(0, 360), Number=int_40, Seed=pshift_39)

random_15 = Random(Range=Domain(0, 360), Number=int_42, Seed=pshift_40)

# ----
graph = GraphMapper(
    random_10,
    x0=0,
    x1=1,
    y0=0,
    y1=1,
    container_name="Bezier",
    cpx=[0, 0.2763824463, 1, 1],
    cpy=[0, 0.2786865234, 0.3680863976, 1])
graph_2 = GraphMapper(
    random_12,
    x0=0,
    x1=1,
    y0=0,
    y1=1,
    container_name="Bezier",
    cpx=[0, 0.3430397809, 1, 1],
    cpy=[0, 0.5653408766, 0.3680863976, 1])
graph_3 = GraphMapper(
    random_13,
    x0=0,
    x1=1,
    y0=0,
    y1=1,
    container_name="Bezier",
    cpx=[0, 0.2961647809, 0.9886363745, 1],
    cpy=[0, 0.6839488745, 0.5063920021, 1])
rad = Radians(Degrees=random_11)
rad_2 = Radians(Degrees=random_14)
rad_3 = Radians(Degrees=random_15)
remap = RemapNumbers(Value=graph, Source=Domain(0, 1), Target=dom)  # -> Mapped, Clipped
remap_2 = RemapNumbers(Value=graph_2, Source=Domain(0, 1), Target=dom_2)  # -> Mapped, Clipped
remap_3 = RemapNumbers(Value=graph_3, Source=Domain(0, 1), Target=dom_3)  # -> Mapped, Clipped
pt_40 = PointCylindrical(BasePlane=graft(pln_3), Angle=rad, Radius=remap.Mapped, Elevation=0)
pt_41 = PointCylindrical(BasePlane=graft(pln_3), Angle=rad_2, Radius=remap_2.Mapped, Elevation=0)
pt_42 = PointCylindrical(BasePlane=graft(pln_3), Angle=rad_3, Radius=remap_3.Mapped, Elevation=0)
tag_8 = TextTag3D(Location=pshift_35, Text=txt_21, Size=number_slider_7, Colour=swatch_2, Justification=5)  # disabled
pshift_43 = ShiftPaths(Data=pt_40, Offset=-1)
pdecon_2 = Deconstruct(Point=pshift_43)  # -> XComponent, YComponent, ZComponent
pshift_44 = ShiftPaths(Data=pt_41, Offset=-1)
pdecon_3 = Deconstruct(Point=pshift_44)  # -> XComponent, YComponent, ZComponent
pshift_45 = ShiftPaths(Data=pt_42, Offset=-1)
pdecon_4 = Deconstruct(Point=pshift_45)  # -> XComponent, YComponent, ZComponent
inc_3 = Includes(Value=pdecon_2.YComponent, Domain=Domain(0, 1000))  # -> Includes, Deviation
inc_4 = Includes(Value=pdecon_2.XComponent, Domain=Domain(0, 1000))  # -> Includes, Deviation
inc_5 = Includes(Value=pdecon_3.YComponent, Domain=Domain(0, 1000))  # -> Includes, Deviation
inc_6 = Includes(Value=pdecon_3.XComponent, Domain=Domain(0, 1000))  # -> Includes, Deviation
inc_7 = Includes(Value=pdecon_4.YComponent, Domain=Domain(0, 1000))  # -> Includes, Deviation
inc_8 = Includes(Value=pdecon_4.XComponent, Domain=Domain(0, 1000))  # -> Includes, Deviation
and_4 = GateAnd(A=inc_4.Includes, B=inc_3.Includes)
and_5 = GateAnd(A=inc_6.Includes, B=inc_5.Includes)
and_6 = GateAnd(A=inc_8.Includes, B=inc_7.Includes)
dispatch_14 = Dispatch(List=pshift_43, DispatchPattern=and_4)  # -> ListA, ListB
dispatch_15 = Dispatch(List=pshift_44, DispatchPattern=and_5)  # -> ListA, ListB
dispatch_16 = Dispatch(List=pshift_45, DispatchPattern=and_6)  # -> ListA, ListB
pt_43 = Point(dispatch_14.ListA)
pt_44 = Point(dispatch_15.ListA)
pt_45 = Point(dispatch_16.ListA)
rnd_reduce_by_ratio_2 = RndReduceByRatio(L=pt_43, B=number_slider_10, S=Slider(52, range=0..100))
rnd_reduce_by_ratio_3 = RndReduceByRatio(L=pt_44, B=number_slider_10, S=Slider(59, range=0..100))
rnd_reduce_by_ratio_4 = RndReduceByRatio(L=pt_45, B=number_slider_10, S=Slider(72, range=0..100))
pt_46 = Point(rnd_reduce_by_ratio_2)
move_22 = Move(Geometry=mesh_25, Motion=pt_46)  # -> Geometry, Transform
pt_47 = Point(rnd_reduce_by_ratio_3)
move_23 = Move(Geometry=mesh_27, Motion=pt_47)  # -> Geometry, Transform
pt_48 = Point(rnd_reduce_by_ratio_4)
move_24 = Move(Geometry=mesh_26, Motion=pt_48)  # -> Geometry, Transform
mjoin_7 = MeshJoin(Meshes=move_22.Geometry)
mjoin_8 = MeshJoin(Meshes=move_24.Geometry)
mjoin_9 = MeshJoin(Meshes=move_23.Geometry)
mcol_4 = MeshColours(Mesh=mjoin_7, Colours=swatch_4)
mcol_5 = MeshColours(Mesh=mjoin_8, Colours=swatch_5)
mcol_6 = MeshColours(Mesh=mjoin_9, Colours=swatch_3)
preview = CustomPreview(Geometry=pt_47, Shader=swatch_3)

# ---- group: building lego modules
mesh_64 = Mesh(move_21.Geometry)

# ----
preview_2 = CustomPreview(Geometry=pt_48, Shader=swatch_5)
preview_3 = CustomPreview(Geometry=pt_46, Shader=swatch_4)
filter_18 = StreamFilter(Gate=show_google_map, Stream0=mesh_64)

# ---- group: old ppl dots mesh
mesh_65 = Mesh(mcol_5)

# ---- group: mid ppl dots mesh
mesh_66 = Mesh(mcol_6)

# ---- group: young ppl dots mesh
mesh_67 = Mesh(mcol_4)

# ---- group: building lego modules
mesh_68 = Mesh(filter_18)

# ---- group: rotation
int_86 = Integer(int_83)

# ----
pt_49 = ConstructPoint(XCoordinate=Slider(3.5, range=0..10), YCoordinate=Slider(-14, range=-30..0), ZCoordinate=Slider(5.1, range=0..10))
panel_57 = Panel(int_75)
move_25 = Move(Geometry=rotate.Geometry, Motion=vec2pt_2.Vector)  # -> Geometry, Transform
panel_58 = Panel(int_79)
panel_59 = Panel(int_83)
panel_60 = Panel(int_35)

# ---- group: total cell #
int_87 = Integer(multiplication_18)

# ----
xy_5 = XYPlane(Origin=pt_49)
comp_3 = Compound(Transforms=flatten([rotate.Transform, move_25.Transform]))
panel_61 = Panel(int_87)

# ---- group: dock lego modules
mesh_69 = Mesh(move_25.Geometry)

# ----
transform_3 = Transform(Geometry=xy_5, Transform=comp_3)

# ---- group: dock lego floor number
tag_9 = TextTag3D(
    Location=transform_3,
    Text=item_37,
    Size=Slider(17, range=0..100),
    Colour=ColourSwatch(SwatchColor=RGB(0, 0, 0)),
    Justification=5)

# ---- group: sticky rotations
python_8 = PythonScript(x=int_83)  # -> out, rotations; inputs x: list; disabled
# ---------- python_8: Python ----------
"""
Realtime Simulator

written by Yan "Ryan" Zhang <ryanz@mit.edu>
for MIT Media Lab, Changing Place Group, CityScope Project
March.7th.2016
"""

import scriptcontext as sc

sc.sticky["rotations"] = x

rotations = sc.sticky["rotations"]
# ---------- end python_8 ----------

# ---- group: sticky y steps
python_9 = PythonScript(x=int_79)  # -> out, ySteps; inputs x: list; disabled
# ---------- python_9: Python ----------
"""
Realtime Simulator

written by Yan "Ryan" Zhang <ryanz@mit.edu>
for MIT Media Lab, Changing Place Group, CityScope Project
March.7th.2016
"""

import scriptcontext as sc

sc.sticky["ySteps"] = x

ySteps = sc.sticky["ySteps"]
# ---------- end python_9 ----------

# ---- group: sticky moduleIDs
python_10 = PythonScript(x=int_35)  # -> out, moduleIDs; inputs x: list; disabled
# ---------- python_10: Python ----------
"""
Realtime Simulator

written by Yan "Ryan" Zhang <ryanz@mit.edu>
for MIT Media Lab, Changing Place Group, CityScope Project
March.7th.2016
"""

import scriptcontext as sc

sc.sticky["moduleIDs"] = x

moduleIDs = sc.sticky["moduleIDs"]
# ---------- end python_10 ----------

# ---- group: sticky x steps
python_11 = PythonScript(x=int_75)  # -> out, xSteps; inputs x: list; disabled
# ---------- python_11: Python ----------
"""
Realtime Simulator

written by Yan "Ryan" Zhang <ryanz@mit.edu>
for MIT Media Lab, Changing Place Group, CityScope Project
March.7th.2016
"""

import scriptcontext as sc

sc.sticky["xSteps"] = x

xSteps = sc.sticky["xSteps"]
# ---------- end python_11 ----------

# ----
panel_62 = Panel(python_8.rotations)  # disabled
panel_63 = Panel(python_8.out)  # disabled
panel_64 = Panel(python_9.ySteps)  # disabled
panel_65 = Panel(python_9.out)  # disabled
panel_66 = Panel(python_11.xSteps)  # disabled
panel_67 = Panel(python_11.out)  # disabled
panel_68 = Panel(python_10.moduleIDs)  # disabled
panel_69 = Panel(python_10.out)  # disabled

# ---- group: module center
pt_50 = Point(modulecenter.pt_5)

# ----
srf_3 = Surface(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)

# ---- group: module id
int_88 = Integer(int_35)

# ---- group: dockID
int_89 = Integer(item_28)

# ----
equals_10 = Equality(FirstNumber=int_38, SecondNumber=int_89)  # -> Equality, Inequality
multiplication_36 = Multiplication(A=equals_10.Inequality, B=6)
addition_3 = Addition(A=int_38, B=multiplication_36)
mesh_70 = Mesh(srf_3)
equals_11 = Equality(FirstNumber=int_89, SecondNumber="-1")  # -> Equality, Inequality
filter_19 = StreamFilter(Gate=equals_11.Equality, Stream0=addition_3, Stream1=int_38)
item_52 = ListItem(List=col, Index=graft(filter_19), Wrap=False)
pshift_46 = ShiftPaths(Data=item_52, Offset=-1)

# ---- group: color for each building
col_2 = Colour(pshift_46)

# ---- group: 3D Buldings
preview_4 = CustomPreview(Geometry=box_2, Shader=col_2)

# ----
equals_12 = Equality(FirstNumber=int_88, SecondNumber=int_89)  # -> Equality, Inequality
Z_7 = UnitZ(Factor=Slider(5.3, range=0..10))
move_26 = Move(Geometry=mesh_70, Motion=Z_7)  # -> Geometry, Transform
dispatch_17 = Dispatch(List=pt_50, DispatchPattern=equals_12.Inequality)  # -> ListA, ListB
vec2pt_8 = Vector2Pt(PointA=Point(0, 0, 0), PointB=dispatch_17.ListA, Unitize=False)  # -> Vector, Length
move_27 = Move(Geometry=move_26.Geometry, Motion=vec2pt_8.Vector)  # -> Geometry, Transform
mjoin_10 = MeshJoin(Meshes=move_27.Geometry)
filter_20 = StreamFilter(Gate=equals_11.Equality, Stream0=mjoin_10)
preview_5 = CustomPreview(Geometry=filter_20, Shader=ColourSwatch(SwatchColor=RGBA(0, 0, 0, 128)))

# ==== cluster ModuleCenter
pt = ClusterInput()
int = ClusterInput()
num = ClusterInput()
int_2 = ClusterInput()

# ---- group: y
int_3 = Integer(int)

# ---- group: cell size
num_2 = Number(num)

# ---- group: x
int_4 = Integer(int_2)

# ---- group: center
pt_2 = Point(pt)

# ----
pt_3 = ConstructPoint(XCoordinate=0, YCoordinate=0, ZCoordinate=0)  # disabled
addition = Addition(A=int_4, B=0.5)
vec2pt = Vector2Pt(PointA=pt_3, PointB=pt_2, Unitize=False)  # -> Vector, Length; disabled
addition_2 = Addition(A=int_3, B=0.5)
multiplication = Multiplication(A=addition, B=num_2)
move = Move(Motion=vec2pt.Vector)  # -> Geometry, Transform; disabled
lng = ListLength(List=int_4)  # disabled
multiplication_2 = Multiplication(A=addition_2, B=num_2)
X = UnitX(Factor=multiplication)
repeat = RepeatData(Data=move.Transform, Length=lng)  # disabled
neg = Negative(Value=multiplication_2)
move_2 = Move(Geometry=pt_2, Motion=X)  # -> Geometry, Transform
graft = GraftTree(Tree=move_2.Transform, IncludeEmptyLists=True, IncludeNullItems=True)  # disabled
Y = UnitY(Factor=neg)
pshift = ShiftPaths(Data=repeat, Offset=-1)  # disabled
move_3 = Move(Geometry=move_2.Geometry, Motion=Y)  # -> Geometry, Transform
graft_2 = GraftTree(Tree=move_3.Transform, IncludeEmptyLists=True, IncludeNullItems=True)  # disabled
comp = Compound(Transforms=[graft, graft_2])  # disabled
graft_3 = GraftTree(Tree=pshift, IncludeEmptyLists=True, IncludeNullItems=True)  # disabled
comp_2 = Compound(Transforms=[comp, graft_3])  # disabled

# ---- group: module center
pt_4 = Point(move_3.Geometry)

# ----
pshift_2 = ShiftPaths(Data=comp_2, Offset=-1)  # disabled
transform = Transform(pshift_2)  # disabled
pt_5 = ClusterOutput(pt_4)
transform_2 = ClusterOutput(transform)  # disabled

# ==== cluster MoveToOrgin
num = ClusterInput()
G = ClusterInput()
num_2 = Number(num)
geobottomcenter = GeoBottomCenter(geo=G)
vec2pt = Vector2Pt(PointA=geobottomcenter, PointB=Point(0, 0, 0), Unitize=False)  # -> Vector, Length
move = Move(Geometry=G, Motion=vec2pt.Vector)  # -> Geometry, Transform
scale_nu = ScaleNU(Geometry=move.Geometry, Plane=PlaneXY(0, 0, 0), ScaleX=num_2, ScaleY=num_2, ScaleZ=1)  # -> Geometry, Transform
G_2 = ClusterOutput(scale_nu.Geometry)

# ==== cluster GeoBottomCenter_2
geo = ClusterInput()
geo_2 = Geometry(geo)
bbox = BoundingBox(Content=geo_2, Plane=PlaneXY(0, 0, 0))  # -> Box, Box_2
box_corners = BoxCorners(Box=bbox.Box)  # -> CornerA, CornerB, CornerC, CornerD, CornerE, CornerF, CornerG, CornerH
pdecon = Deconstruct(Point=box_corners.CornerA)  # -> XComponent, YComponent, ZComponent
pdecon_2 = Deconstruct(Point=box_corners.CornerC)  # -> XComponent, YComponent, ZComponent
addition = Addition(A=pdecon.XComponent, B=pdecon_2.XComponent)
addition_2 = Addition(A=pdecon.YComponent, B=pdecon_2.YComponent)
division = Division(A=addition, B=2)
division_2 = Division(A=addition_2, B=2)
pt = ConstructPoint(XCoordinate=division, YCoordinate=division_2, ZCoordinate=pdecon.ZComponent)
pshift = ShiftPaths(Data=pt, Offset=-1)
pt_2 = Point(pshift)
pt_3 = ClusterOutput(pt_2)

# ==== cluster EasterEggs
panel = Panel("79")  # disabled
panel_2 = Panel("30")  # disabled
subtraction = Subtraction(A=panel, B=1)  # disabled
subtraction_2 = Subtraction(A=panel_2, B=1)  # disabled
sqgrid = Square(Plane=PlaneXY(0, 0, 0), Size=1, ExtentX=subtraction, ExtentY=subtraction_2)  # -> Cells, Points; disabled
pdecon = Deconstruct(Point=sqgrid.Points)  # -> XComponent, YComponent, ZComponent; disabled
division = Division(A=pdecon.XComponent, B=panel)  # disabled
division_2 = Division(A=pdecon.YComponent, B=panel_2)  # disabled
pt = ConstructPoint(XCoordinate=division, YCoordinate=division_2, ZCoordinate=0)  # disabled
ahsv = SplitAHSV()  # -> Alpha, Hue, Saturation, Value; disabled
smaller = SmallerThan(FirstNumber=ahsv.Alpha, SecondNumber=1)  # -> SmallerThan, OrEqualTo; disabled
dispatch = Dispatch(List=sqgrid.Points, DispatchPattern=smaller.SmallerThan)  # -> ListA, ListB; disabled
dispatch_2 = Dispatch(DispatchPattern=smaller.SmallerThan)  # -> ListA, ListB; disabled
vec = VectorXYZ(XComponent=2, YComponent=-2, ZComponent=-10)  # -> Vector, Length; disabled
planesrf = PlaneSurface(Plane=dispatch.ListB, XSize=Domain(-0.5, 0.5), YSize=Domain(-0.5, 0.5))  # disabled
mesh = Mesh(flatten(planesrf))  # disabled
col = Colour(flatten(dispatch_2.ListB))  # disabled
mspray = MeshSpray(Mesh=graft(mesh), Points=Point(0, 0, 0), Colours=graft(col), SprayMode=0)  # disabled
mjoin = MeshJoin(Meshes=flatten(mspray))  # disabled
move = Move(Geometry=mjoin, Motion=vec.Vector)  # -> Geometry, Transform; disabled
mcol = MeshColours(Mesh=move.Geometry, Colours=RGB(0, 0, 0))  # disabled
preview = CustomPreview(Geometry=planesrf, Shader=dispatch_2.ListB)  # disabled
mjoin_2 = MeshJoin(Meshes=flatten([mjoin, mcol]))  # disabled
toggle = BooleanToggle(False)  # disabled
toggle_2 = BooleanToggle(False)  # disabled
panel_3 = Panel("7")  # disabled
swatch = ColourSwatch(SwatchColor=RGB(0, 0, 0))  # disabled
swatch_2 = ColourSwatch(SwatchColor=RGB(255, 115, 0))  # disabled

# ---- group: module meshes lego ref: 7 - J
mesh_2 = Mesh(<mesh referenced from the Rhino model>)  # disabled

# ---- group: on screen mesh ref: 8 - X
mesh_3 = Mesh(<mesh referenced from the Rhino model>)  # disabled

# ---- group: module meshes lego ref: 8 - X
mesh_4 = Mesh(<mesh referenced from the Rhino model>)  # disabled

# ----
panel_4 = Panel("7")  # disabled
mesh_5 = Mesh(<mesh referenced from the Rhino model>)  # disabled

# ---- group: on screen mesh ref: 7 - J
mesh_6 = Mesh(mjoin_2)  # disabled

# ----
mcol_2 = MeshColours(Mesh=mesh_3, Colours=swatch_2)  # disabled
mcol_3 = MeshColours(Mesh=mesh_5, Colours=swatch)  # disabled
shrink = ClusterInput()
shrink_2 = ClusterInput()
movetoorgin = MoveToOrgin(G=mesh_2, num=shrink)  # disabled
movetoorgin_2 = MoveToOrgin(G=mesh_4, num=shrink_2)  # disabled
mjoin_3 = MeshJoin(Meshes=[mcol_2, mcol_3])  # disabled

# ---- group: module meshes lego at orgin
mesh_7 = Mesh(movetoorgin)  # disabled

mesh_8 = Mesh(movetoorgin_2)  # disabled

# ----
A = ClusterInput()
A_2 = ClusterInput()
equals = Equality(FirstNumber=A, SecondNumber=panel_4)  # -> Equality, Inequality; disabled
int = Integer(equals.Equality)  # disabled
ma = MassAddition(Input=int)  # -> Result, PartialResults; disabled
larger = LargerThan(FirstNumber=ma.Result, SecondNumber=0)  # -> LargerThan, OrEqualTo; disabled
equals_2 = Equality(FirstNumber=A_2, SecondNumber=panel_3)  # -> Equality, Inequality; disabled
L = ClusterInput()
int_2 = Integer(equals_2.Equality)  # disabled
ma_2 = MassAddition(Input=int_2)  # -> Result, PartialResults; disabled
larger_2 = LargerThan(FirstNumber=ma_2.Result, SecondNumber=0)  # -> LargerThan, OrEqualTo; disabled
L_2 = ClusterInput()
dispatch_3 = Dispatch(List=L, DispatchPattern=equals_2.Equality)  # -> ListA, ListB; disabled

# ---- group: if has this special id
bool = Boolean(larger.LargerThan)  # disabled

bool_2 = Boolean(bool)  # disabled

# ----
getcamera = GetCamera(GetCamera=bool_2)  # -> Location, Target, LensLength, UpDirection; disabled
ln = Line(StartPoint=getcamera.Location, EndPoint=getcamera.Target)  # disabled
getplanefrom2pts = GetPlaneFrom2pts(pt_2=getcamera.Location, pt=getcamera.Target)  # disabled
dispatch_4 = Dispatch(List=L_2, DispatchPattern=equals.Equality)  # -> ListA, ListB; disabled
number_slider = Slider(6.4, range=0..10)  # disabled
number_slider_2 = Slider(14.4, range=0..100)  # disabled
pt_2 = ConstructPoint(XCoordinate=500, YCoordinate=500, ZCoordinate=20)  # disabled

# ---- group: if has this special id
bool_3 = Boolean(larger_2.LargerThan)  # disabled

bool_4 = Boolean(bool_3)  # disabled

# ----
getcamera_2 = GetCamera(GetCamera=bool_4)  # -> Location, Target, LensLength, UpDirection; disabled
ln_2 = Line(StartPoint=getcamera_2.Location, EndPoint=getcamera_2.Target)  # disabled
getplanefrom2pts_2 = GetPlaneFrom2pts(pt_2=getcamera_2.Location, pt=getcamera_2.Target)  # disabled
vec2pt = Vector2Pt(PointA=Point(0, 0, 0), PointB=dispatch_3.ListA, Unitize=False)  # -> Vector, Length; disabled
vec2pt_2 = Vector2Pt(PointA=Point(0, 0, 0), PointB=dispatch_4.ListA, Unitize=False)  # -> Vector, Length; disabled
move_2 = Move(Geometry=mesh_7, Motion=vec2pt.Vector)  # -> Geometry, Transform; disabled
pt_3 = Point(pt_2)  # disabled
move_3 = Move(Geometry=mesh_8, Motion=vec2pt_2.Vector)  # -> Geometry, Transform; disabled

# ---- group: current cam canvas pln
pln = Plane(getplanefrom2pts)  # disabled

pln_2 = Plane(getplanefrom2pts_2)  # disabled

# ----
xy = XYPlane(Origin=pt_3)  # disabled
number_slider_3 = Slider(0.01, range=0.001..1)  # disabled
number_slider_4 = Slider(0.01, range=0.001..1)  # disabled
number_slider_5 = Slider(0.81, range=0.001..101)  # disabled
movetoorgin_3 = MoveToOrgin(G=mjoin_3, num=number_slider)  # disabled
movetoorgin_4 = MoveToOrgin(G=mesh_6, num=number_slider_2)  # disabled
orient = Orient(Geometry=movetoorgin_4, Source=PlaneXY(0, 0, 0), Target=xy)  # -> Geometry, Transform; disabled
orient_2 = Orient(Geometry=movetoorgin_3, Source=PlaneXY(0, 0, 0), Target=pln)  # -> Geometry, Transform; disabled
orient_3 = Orient(Geometry=movetoorgin_4, Source=PlaneXY(0, 0, 0), Target=pln_2)  # -> Geometry, Transform; disabled
scale = Scale(Geometry=orient_2.Geometry, Center=getcamera.Location, Factor=number_slider_3)  # -> Geometry, Transform; disabled
scale_2 = Scale(Geometry=orient_3.Geometry, Center=getcamera_2.Location, Factor=number_slider_4)  # -> Geometry, Transform; disabled
scale_3 = Scale(Geometry=orient.Geometry, Center=pt_3, Factor=number_slider_5)  # -> Geometry, Transform; disabled
filter = StreamFilter(Gate=bool_2, Stream1=scale.Geometry)  # disabled
filter_2 = StreamFilter(Gate=bool_4, Stream1=scale_2.Geometry)  # disabled
filter_3 = StreamFilter(Gate=bool_4, Stream1=scale_3.Geometry)  # disabled

# ---- group: special JR
mesh_9 = Mesh(move_2.Geometry)  # disabled

# ---- group: on 3d view
mesh_10 = Mesh(filter)  # disabled

# ---- group: special Xin
mesh_11 = Mesh(move_3.Geometry)  # disabled

# ---- group: on 3d view
mesh_12 = Mesh(filter_2)  # disabled

# ---- group: on lego
mesh_13 = Mesh(filter_3)  # disabled

# ==== cluster RndReduceByRatio
L = ClusterInput()
B = ClusterInput()
lng = ListLength(List=L)
S = ClusterInput()
multiplication = Multiplication(A=lng, B=B)
reduce = RandomReduce(List=L, Reduction=multiplication, Seed=S)
L_2 = ClusterOutput(reduce)

# ==== cluster GeoBottomCenter
geo = ClusterInput()
geo_2 = Geometry(geo)
bbox = BoundingBox(Content=geo_2, Plane=PlaneXY(0, 0, 0))  # -> Box, Box_2
box_corners = BoxCorners(Box=bbox.Box)  # -> CornerA, CornerB, CornerC, CornerD, CornerE, CornerF, CornerG, CornerH
pdecon = Deconstruct(Point=box_corners.CornerA)  # -> XComponent, YComponent, ZComponent
pdecon_2 = Deconstruct(Point=box_corners.CornerC)  # -> XComponent, YComponent, ZComponent
addition = Addition(A=pdecon.XComponent, B=pdecon_2.XComponent)
addition_2 = Addition(A=pdecon.YComponent, B=pdecon_2.YComponent)
division = Division(A=addition, B=2)
division_2 = Division(A=addition_2, B=2)
pt = ConstructPoint(XCoordinate=division, YCoordinate=division_2, ZCoordinate=pdecon.ZComponent)
pt_2 = Point(pt)
pt_3 = ClusterOutput(pt_2)

# ==== cluster GetPlaneFrom2pts
pt = ClusterInput()
pt_2 = ClusterInput()

# ---- group: current cam tgt pos
pt_3 = Point(pt)

# ---- group: current cam pos
pt_4 = Point(pt_2)

# ----
Z = UnitZ(Factor=100)
move = Move(Geometry=pt_3, Motion=Z)  # -> Geometry, Transform
pl_3pt = Plane3Pt(PointA=pt_3, PointB=pt_4, PointC=move.Geometry)
pt_5 = PointOriented(BasePlane=pl_3pt, UComponent=0, VComponent=0, WComponent=-100)
pt_6 = PointOriented(BasePlane=pl_3pt, UComponent=0, VComponent=100, WComponent=0)
pl_3pt_2 = Plane3Pt(PointA=pt_3, PointB=pt_5, PointC=pt_6)
pln = Plane(pl_3pt_2)
pln_2 = ClusterOutput(pln)
